# Grasshopper definition colorMatching_Deserialise.gh (Grasshopper 1.0.7)

path = FilePath("/Users/mp/Documents/GitHub/qr-art.github.io/LegoPaint/Database/1x1_LegoColors.csv")
list = ValueList({"Plate 1 x 1": 3024}, selected="Plate 1 x 1")
c_script = CSharpScript(ITEMID=list, COLOR="50", QUANTITY="20")  # -> out, INVENTORY; inputs ITEMID: Int32, COLOR: list of Int32, QUANTITY: list of Int32
# ---------- c_script: C# usings ----------
using System.Xml.Serialization;
using System.Xml;
using System.Reflection;
using System.IO;
# ---------- c_script: C# ----------
    var legoItems = new List<LegoItem>();
    
    ITEMID = 3024; // plate 1x1
    for (int i = 0; i < COLOR.Count; i++)
    {
      var piece = new LegoItem("P", ITEMID, COLOR[i], QUANTITY[i]);
      legoItems.Add(piece);
    }



    var _inventory = new Inventory(legoItems).SerializeToString();

    INVENTORY = _inventory;
# ---------- c_script: C# additional code ----------
  public class LegoItem
  {
    [XmlElement("ITEMTYPE")]
    public string ItemType = "P";

    [XmlElement("MINQTY")]
    public int NumberOfItem;

    [XmlElement("COLOR")]
    public int Color;

    [XmlElement("ITEMID")]
    public int Id;


    public LegoItem()
    {
    }


    public LegoItem(string itemType, int id, int color, int numberOfItem)
    {
      this.ItemType = itemType;
      this.NumberOfItem = numberOfItem;
      this.Color = color;
      this.Id = id;
    }


    public string SerializeToString()
    {
      // serialize
      XmlSerializer serializer = new XmlSerializer(typeof(LegoItem));
      using (TextWriter writer = new StringWriter())
      {
        serializer.Serialize(writer, this);
        return writer.ToString();
      }
    }
  }


  [System.Serializable]
  [XmlRoot("INVENTORY")]
  public class Inventory
  {
    [XmlElement("ITEM")]
    public List<LegoItem> LegoItems;

    public Inventory()
    {
    }

    public Inventory(List<LegoItem> legoItems)
    {
      this.LegoItems = legoItems;
    }


    public string SerializeToString()
    {

      var xns = new XmlSerializerNamespaces();
      xns.Add(string.Empty, string.Empty);

      // serialize
      XmlSerializer serializer = new XmlSerializer(typeof(Inventory));
      using (TextWriter writer = new StringWriter())
      {
        serializer.Serialize(writer, this, xns);
        return writer.ToString();
      }
    }


  }
# ---------- end c_script ----------
python = GhPythonScript(database=path)  # -> out, content, color_id, rgb, text
# ---------- python: Python ----------
__author__ = "mp"

import rhinoscriptsyntax as rs
import Grasshopper as gh
import ghpythonlib.treehelpers as gt
import System


with open(database, "r") as f:
    lines = f.readlines()
    
content = [line.decode("UTF-8").strip() for line in lines]

a = content[1:]

b = []
for i in a:
    b.append( i.split(",") )
    

rgb = []

for item in b:
    hex = item[0]
    clr = tuple(int(hex[i:i+2], 16) for i in (0, 2, 4))
    rgb.append( System.Drawing.Color.FromArgb(clr[0], clr[1], clr[2]) )

##{4}, Code {0} - {1}, Id {5}, HEX {2}, {3}

text = []
color_id = []
for i, item in enumerate(b):
    txt = "{0}, Code {1} - {2}, Id {3}, HEX {4}, RGB {5}".format(i, item[1], item[2], item[3], item[0], rgb[i])
    text.append(txt)
    color_id.append(item[3])
# ---------- end python ----------
legend = Legend(Colour=python.rgb, Tags=python.text, LegendType=1)
