# Grasshopper definition gioconda_simplified.gh (Grasshopper 1.0.7)
# plug-ins: Javid, MeshEdit Components

path = FilePath("/Users/mp/Documents/GitHub/qr-art.github.io/LegoPaint/Database/1x1_LegoColors.csv")
python = GhPythonScript(database=path)  # -> out, content, color_id, rgb, text
# ---------- python: Python ----------
__author__ = "mp"

import rhinoscriptsyntax as rs
import Grasshopper as gh
import ghpythonlib.treehelpers as gt
import System


with open(database, "r") as f:
    lines = f.readlines()
    
content = [line.decode("UTF-8").strip() for line in lines]

a = content[1:]

b = []
for i in a:
    b.append( i.split(",") )
    

rgb = []

for item in b:
    hex = item[0]
    clr = tuple(int(hex[i:i+2], 16) for i in (0, 2, 4))
    rgb.append( System.Drawing.Color.FromArgb(clr[0], clr[1], clr[2]) )

##{4}, Code {0} - {1}, Id {5}, HEX {2}, {3}

text = []
color_id = []
for i, item in enumerate(b):
    txt = "{0}, Code {1} - {2}, Id {3}, HEX {4}, RGB {5}".format(i, item[1], item[2], item[3], item[0], rgb[i])
    text.append(txt)
    color_id.append(item[3])
# ---------- end python ----------
path_2 = FilePath("/Users/mp/Documents/GitHub/qr-art.github.io/pixel-art/assets/gioconda_square.jpg")
path_3 = FilePath("/Users/mp/Documents/GitHub/qr-art.github.io/LegoPaint/References/vangogh_mutilated_ear.webp")
open = OpenBitmap(File=path_3)
multiplication = Multiplication(A="48", B=Slider(4, range=1..4))
preview_bitmap = PreviewBitmap(Bitmap=open, LockAspect=False)
division = Division(A="40")
pixelart = PixelArt(Bitmap=open, Palette=python.rgb, Ex=multiplication, Size="1")  # -> Bitmap, Mesh
explode = MeshExplode(Mesh=pixelart.Mesh, Interpolate=False)
demesh = DeconstructMesh(Mesh=explode)  # -> Vertices, Faces, Colours, Normals
mjoin = MeshJoin(Meshes=explode)
item = ListItem(List=demesh.Colours, Index=0, Wrap=True)  # -> flatten(Item)
cset = CreateSet(List=flatten(item))  # -> Set, Map
cp = ClosestPoint(Point=cset.Set, Cloud=python.rgb)  # -> ClosestPoint, CPIndex, Distance
legend = Legend(Colour=python.rgb, Tags=python.text, LegendType=1)
item_2 = ListItem(List=python.color_id, Index=cp.CPIndex, Wrap=True)
txt = Text(item)
txt_2 = Text(cset.Set)
mindex = MemberIndex(Set=txt, Member=txt_2)  # -> Index, Count
lng = ListLength(List=mindex.Index)  # -> flatten(Length)
panel = Panel(lng)
panel_2 = Panel(item_2)
list = ValueList({"Plate 1 x 1": 3024}, selected="Plate 1 x 1")
c_script = CSharpScript(ITEMID=list, COLOR=panel_2, QUANTITY=panel)  # -> out, INVENTORY; inputs ITEMID: Int32, COLOR: list of Int32, QUANTITY: list of Int32
# ---------- c_script: C# usings ----------
using System.Xml.Serialization;
using System.Xml;
using System.Reflection;
using System.IO;
# ---------- c_script: C# ----------
    var legoItems = new List<LegoItem>();
    
    ITEMID = 3024; // plate 1x1
    for (int i = 0; i < COLOR.Count; i++)
    {
      var piece = new LegoItem("P", ITEMID, COLOR[i], QUANTITY[i]);
      legoItems.Add(piece);
    }



    var _inventory = new Inventory(legoItems).SerializeToString();

    INVENTORY = _inventory;
# ---------- c_script: C# additional code ----------
  public class LegoItem
  {
    [XmlElement("ITEMTYPE")]
    public string ItemType = "P";

    [XmlElement("MINQTY")]
    public int NumberOfItem;

    [XmlElement("COLOR")]
    public int Color;

    [XmlElement("ITEMID")]
    public int Id;


    public LegoItem()
    {
    }


    public LegoItem(string itemType, int id, int color, int numberOfItem)
    {
      this.ItemType = itemType;
      this.NumberOfItem = numberOfItem;
      this.Color = color;
      this.Id = id;
    }


    public string SerializeToString()
    {
      // serialize
      XmlSerializer serializer = new XmlSerializer(typeof(LegoItem));
      using (TextWriter writer = new StringWriter())
      {
        serializer.Serialize(writer, this);
        return writer.ToString();
      }
    }
  }


  [System.Serializable]
  [XmlRoot("INVENTORY")]
  public class Inventory
  {
    [XmlElement("ITEM")]
    public List<LegoItem> LegoItems;

    public Inventory()
    {
    }

    public Inventory(List<LegoItem> legoItems)
    {
      this.LegoItems = legoItems;
    }


    public string SerializeToString()
    {

      var xns = new XmlSerializerNamespaces();
      xns.Add(string.Empty, string.Empty);

      // serialize
      XmlSerializer serializer = new XmlSerializer(typeof(Inventory));
      using (TextWriter writer = new StringWriter())
      {
        serializer.Serialize(writer, this, xns);
        return writer.ToString();
      }
    }


  }
# ---------- end c_script ----------
panel_3 = Panel(c_script.INVENTORY)
python_2 = GhPythonScript(button=Toggle(True), url="https://www.bricklink.com/v2/wanted/upload.page")  # -> out, a; inputs button: Boolean
# ---------- python_2: Python ----------
import webbrowser
import System

if button:
    System.Diagnostics.Process.Start(url);
# ---------- end python_2 ----------
