# Grasshopper definition legoPaint.gh (Grasshopper 1.0.7)
# plug-ins: Noise, MeshEdit Components, NGon, treesloth01, LunchBoxML, EleFront

number_slider = Slider(2, range=2..6)
mm = Panel("385")
sqgrid = Square(Plane=PlaneXY(0, 0, 0), Size=mm, ExtentX="1", ExtentY="1")  # -> Cells, Points
crv = Curve(sqgrid.Cells)
mplane = MeshPlane(Boundary=crv, WidthCount="48", HeightCount="48")  # -> Mesh, Area
face_normals = FaceNormals(Mesh=mplane.Mesh)  # -> flatten(Centers), Normals
mesh_join = MeshJoin(Meshes=flatten(mplane.Mesh))
mesh_explode = MeshExplode(Mesh=mesh_join, Interpolate=False)

# ----
# Perlin Noise 2d
panel = Panel("2")
series = Series(Start=0, Step=panel, Count="50")
number_slider_2 = Slider(1, range=1..10)
vector_xyz = VectorXYZ(XComponent=Slider(0.5, range=-0.5..0.5), YComponent=Slider(0.5, range=-0.5..0.5), ZComponent=0)  # -> Vector, Length
number_slider_3 = Slider(5, range=1..5)
perlinnoise = PerlinNoise(
    Points=face_normals.Centers,
    Seed=0,
    Amplitude=1,
    SmoothStep=0,
    FrequecyX=number_slider_2,
    FrequecyY=number_slider_2,
    FrequecyZ=number_slider_2,
    Jitter=Slider(-0.94, range=-1..1),
    AlignVector=vector_xyz.Vector)
pi = Pi(Factor=1)
multiplication = Multiplication(A=perlinnoise, B=pi, C=Slider(4.36, range=0..10))
sine = Sine(Value=multiplication)
stream_filter = StreamFilter(Gate="1", Stream0=perlinnoise, Stream1=sine)

series_2 = Series(Start=0, Step=panel, Count="25")
ghpython_script = GhPythonScript()  # -> out, r, g, b
# ---------- ghpython_script: Python ----------
colors =    {1:"124,92,66",
             2: "126,156,134",
             3: "102,43,50",
             4:  "80,44,25",
             5: "147,148,147",
             6: "101,101,101",
             7: "209,130,60",
             8: "83,161,90",
             9: "174,37,26",
             10: "130,95,154",
             11: "42,60,99",
             12: "237,199,67",
             13: "53,96,171",
             14: "176,163,118",
             15: "76,76,76",
             16: "215,215,215",
             17: "133,79,53",
             18: "164,182,215",
             19: "233,184,154",
             20: "58,81,61",
             21: "72,126,167",
             22: "159,188,83",
             23: "87,68,141",
             24: "198,68,156",
             25: "65,137,133",
             26: "61,47,21",
             27: "108,156,180",
             28: "132,64,120",
             29: "185,205,200",
             30: "248,226,129",
             31: "103,108,55",
             32: "228,154,197",
             33: "228,162,68"}

keys = colors.keys()

r = []
g = []
b = []

for i in keys:
    a = colors[i]

    items = a.split(",")

    r.append( items[0] )
    g.append( items[1] )
    b.append( items[2] )
# ---------- end ghpython_script ----------
colour_rgb = ColourRGB(Alpha=255, Red=ghpython_script.r, Green=ghpython_script.g, Blue=ghpython_script.b)
list_length = ListLength(List=colour_rgb)
series_3 = Series(Start=0, Step=1, Count=list_length)
legend = Legend(Colour=colour_rgb, Tags=series_3, LegendType=1)
panel_2 = Panel("""10
11
12""")
panel_3 = Panel("""8
11
7
20""")
panel_4 = Panel("""21
22
23""")
list_item = ListItem(List=colour_rgb, Index=panel_2, Wrap=True)
list_item_2 = ListItem(List=colour_rgb, Index=panel_3, Wrap=True)
list_item_3 = ListItem(List=colour_rgb, Index=panel_4, Wrap=True)
entwine = Entwine(
    Branch00=ColourSwatch(SwatchColor=RGB(255, 135, 0)),
    Branch01=ColourSwatch(SwatchColor=RGB(255, 202, 0)),
    Branch02=ColourSwatch(SwatchColor=RGB(255, 44, 0)),
    FlattenInputs=True)
entwine_2 = Entwine(
    Branch00=ColourSwatch(SwatchColor=RGB(13, 0, 0)),
    Branch01=ColourSwatch(SwatchColor=RGBA(0, 0, 0, 161)),
    Branch02=ColourSwatch(SwatchColor=RGBA(0, 0, 0, 85)),
    Branch03=ColourSwatch(SwatchColor=RGBA(0, 0, 0, 0)),
    FlattenInputs=True)
graft_tree = GraftTree(Tree=list_item, IncludeEmptyLists=True, IncludeNullItems=True)
graft_tree_2 = GraftTree(Tree=list_item_2, IncludeEmptyLists=True, IncludeNullItems=True)
graft_tree_3 = GraftTree(Tree=list_item_3, IncludeEmptyLists=True, IncludeNullItems=True)
value_list = ValueList({"0", "1", "2", "3", "4"}, selected="0")
stream_filter_2 = StreamFilter(Gate=value_list, Stream0=entwine, Stream1=entwine_2, Stream2=graft_tree, Stream3=graft_tree_2, Stream4=graft_tree_3)
entwine_3 = Entwine(
    Branch0X=entwine,
    Branch1X=entwine_2,
    Branch2X=graft_tree,
    Branch3X=graft_tree_2,
    Branch4X=graft_tree_3,
    FlattenInputs=False)  # -> simplify(Result)
tree_statistics = TreeStatistics(Tree=stream_filter_2)  # -> Paths, Length, Count
data = Data(stream_filter)
shift = ShiftPaths(Data=entwine_3, Offset=-1)
graft = GraftTree(Tree=data, IncludeEmptyLists=True, IncludeNullItems=True)
lng = ListLength(List=shift)  # -> flatten(Length)
kmeans = KMeans(NumberOfClusters=graft(tree_statistics.Count), D=data, D_2=data, D_3=data)  # -> Index, DataTree
k_means = KMeansClustering(TrainingInputs=graft, OfClusters=lng, RandomSeed=5)  # -> Result, Likelihood, Centroids
param_viewer = ParamViewer(kmeans.DataTree)
cset = CreateSet(List=k_means.Result)  # -> Set, Map
mindex = MemberIndex(Set=k_means.Result, Member=cset.Set)  # -> simplify(Index), Count
list_item_4 = ListItem(List=mesh_explode, Index=mindex.Index, Wrap=True)
jitter = Jitter(List=param_viewer, Jitter=1, Seed=Slider(14, range=0..20))  # -> Values, Indices
tree_branch = TreeBranch(Tree=kmeans.DataTree, Path=jitter.Values, MaintainPaths=False)
mesh_colours = MeshColours(Mesh=list_item_4, Colours=entwine_3)
curve = Curve(flatten(crv))
cluster = Data(tree_branch)
shift_2 = ShiftPaths(Data=simplify(mesh_colours), Offset=-1)
ghpython_script_2 = GhPythonScript(Cluster=cluster, iCurve=curve, platePrice="8.99", brickPrice="0.06")  # -> out, totalCost; inputs Cluster: tree of Int32, iCurve: list of Curve
# ---------- ghpython_script_2: Python ----------
__author__ = "mpmac"

import rhinoscriptsyntax as rs


number_of_tree = Cluster.BranchCount
for i in range(number_of_tree):
    value = Cluster.Branch(i).Count
    print "Cluster {0}: {1:4} pcs".format(i+1,value)

number_of_brick = Cluster.DataCount

brickCost = number_of_brick * brickPrice

number_of_plate = len(iCurve)
plateCost = number_of_plate * platePrice

totalCost = brickCost + plateCost

print "Number of Brick: {0:4}".format(number_of_brick)
print "Number of Plate: {0:4}".format(number_of_plate)
print "Bricks Cost: {0:6} €".format(brickCost)
print "Plates Cost: {0:6} €".format(plateCost)
print "--------------------"
print "Total Cost:  {0:6} €".format(totalCost)
# ---------- end ghpython_script_2 ----------
mesh_join_2 = MeshJoin(Meshes=shift_2)
tstat = TreeStatistics(Tree=mesh_join_2)  # -> Paths, Length, Count
multiplication_2 = Multiplication(A=mm, B=1.15)
sqrt = SquareRoot(Value=tstat.Count)
panel_5 = Panel(ghpython_script_2.out)
panel_6 = Panel(ghpython_script_2.totalCost)
round = Round(Number=sqrt)  # -> Nearest, Floor, Ceiling
sqgrid_2 = Square(Plane=PlaneXY(0, 0, 0), Size=multiplication_2, ExtentX=round.Ceiling, ExtentY=round.Ceiling)  # -> flatten(Cells), Points
split = SplitList(List=sqgrid_2.Cells, Index=tstat.Count)  # -> ListA, ListB
area = Area(Geometry=split.ListA)  # -> Area, Centroid
area_2 = MeshArea(Mesh=mesh_join_2)  # -> Area, flatten(Centroid)
subtraction = Subtraction(A=area.Centroid, B=area_2.Centroid)
move = Move(Geometry=flatten(mesh_join_2), Motion=subtraction)  # -> Geometry, Transform
inblock = InsertBlock(BlockName="1 stub", SourcePlane=PlaneXY(0, 0, 0))
orient = Orient(Geometry=inblock, Source=PlaneXY(0, 0, 0), Target=PlaneXY(0, 0, 0))  # -> Geometry, Transform
