# Grasshopper definition legoPaint_Gioconda_v6.gh (Grasshopper 1.0.7)
# plug-ins: treesloth01, ShapeDiverForGrasshopper, ThreePlus
# {"9d1e0554-0403-4a6d-a053-d5d89c686a6f": [false, true], "603903b1-473f-4238-bb00-dff0a644fc8e": [true, false]}

imagepath = FilePath("/Users/mp/Documents/GitHub/qr-art.github.io/LegoPaint/References/gioconda-orig.avif")
toggle = BooleanToggle(False)
image_resource = ImageResource(imagepath)
python = GhPythonScript(FilePath=image_resource)  # -> out, FilePath, image, resolution_x, resolution_y
# ---------- python: Python ----------
__author__ = "Marco"
__version__ = "2022.11.19"

import rhinoscriptsyntax as rs
from System.Drawing import Color, Bitmap
import Rhino.Geometry as rg

image = Bitmap(FilePath)

resolution_x = image.Width
resolution_y = image.Height

image.Dispose()
# ---------- end python ----------

# ----
# ALL LEGO DATABASE
path = FilePath("C:\GitHub\qr-art.github.io\LegoPaint\Database\LegoColors_Database.csv")
file = ReadFile(File=path, PerLineParse=True)
split_list = SplitList(List=file, Index="2")  # -> ListA, ListB
split = TextSplit(Text=split_list.ListB, Separators=",")
item = ListItem(List=split, Index=0, Wrap=True)  # -> flatten(Item), flatten(Item1), flatten(Item2)
panel = Panel(item.Item)
python_2 = GhPythonScript(h=panel)  # -> out, a
# ---------- python_2: Python ----------
__author__ = "Marco"
__version__ = "2022.11.23"

import rhinoscriptsyntax as rs

a = tuple(int(h[i:i+2], 16) for i in (0, 2, 4))
# ---------- end python_2 ----------
item_2 = ListItem(List=python_2.a, Index=0, Wrap=True)  # -> Item, Item1, Item2
rgb = ColourRGB(Alpha=255, Red=item_2.Item, Green=item_2.Item1, Blue=item_2.Item2)  # -> flatten(Colour)
format = Format(Format="Code {0} - {1}", Culture=127, Data0=item.Item1, Data1=item.Item2)
legend = Legend(Colour=rgb, Tags=format, LegendType=1)

panel_2 = Panel(python.resolution_y)
panel_3 = Panel(python.resolution_x)
division = Division(A=panel_3, B=panel_2)

# ----
# Available Dataset
path_2 = FilePath("C:\GitHub\qr-art.github.io\LegoPaint\Database\1x1_LegoColors.csv")
file_2 = ReadFile(File=path_2, PerLineParse=True)
panel_4 = Panel(file_2)

list = ValueList({"48", "96", "144", "192"}, selected="144")
panel_5 = Panel("144")
panel_6 = Panel(division)
list_2 = ValueList({"48", "96", "144", "192"}, selected="192")
multiplication = Multiplication(A=list, B=panel_6)
num = Number(list_2)
num_2 = Number(list)
c_script = CSharpScript(filepath=python.FilePath, x=num, y=num_2)  # -> out, ResizedImage, ResolutionX, ResolutionY, preview; inputs filepath: String, x: Int32, y: Int32
# ---------- c_script: C# usings ----------
using System.Drawing.Configuration;
using System.Drawing;
using System.Drawing.Imaging;
using System.Drawing.Drawing2D;
# ---------- c_script: C# ----------
    var image = System.Drawing.Image.FromFile(filepath);
    var oImage = ResizeImage(image, x, y);

    var filePath = @"C:\GitHub\qr-art.github.io\LegoPaint\References\Shapes100.jpg";
    oImage.Save(filePath);
    ResolutionX = oImage.Width;
    ResolutionY = oImage.Height;
    preview = filePath;
    ResizedImage = oImage;
# ---------- c_script: C# additional code ----------
  /// <summary>
  /// Resize the image to the specified width and height.
  /// </summary>
  /// <param name="image">The image to resize.</param>
  /// <param name="width">The width to resize to.</param>
  /// <param name="height">The height to resize to.</param>
  /// <returns>The resized image.</returns>
  public static Bitmap ResizeImage(Image image, int width, int height)
  {
    var destRect = new Rectangle(0, 0, width, height);
    var destImage = new Bitmap(width, height);

    destImage.SetResolution(image.HorizontalResolution, image.VerticalResolution);
    using (var graphics = Graphics.FromImage(destImage))
    {
      graphics.CompositingMode = CompositingMode.SourceCopy;
      graphics.CompositingQuality = CompositingQuality.HighQuality;
      graphics.InterpolationMode = InterpolationMode.HighQualityBicubic;
      graphics.SmoothingMode = SmoothingMode.HighQuality;
      graphics.PixelOffsetMode = PixelOffsetMode.HighQuality;

      using (var wrapMode = new ImageAttributes())
      {
        wrapMode.SetWrapMode(WrapMode.TileFlipXY);
        graphics.DrawImage(image, destRect, 0, 0, image.Width, image.Height, GraphicsUnit.Pixel, wrapMode);
      }
    }

    return destImage;
  }
# ---------- end c_script ----------
image_resource_2 = ImageResource(c_script.preview)
split_list_2 = SplitList(List=panel_4, Index="2")  # -> ListA, ListB
split_2 = TextSplit(Text=split_list_2.ListB, Separators=",")
item_3 = ListItem(List=split_2, Index=0, Wrap=True)  # -> flatten(Item), flatten(Item1), flatten(Item2)

fsdither = PythonicFloydSteinbergDithering(image=c_script.ResizedImage, ResolutionX="1", ResolutionY="1", Factor="200")  # -> out, Bounds, Points, Colors; inputs ResolutionX: Int32, ResolutionY: Int32
# ---------- fsdither: Python ----------
"""Pythonic Floyd-Steinberg Image Dithering Algorithm.
    ---
    The algorithm was first published in 1976 by Robert W. Floyd and Louis Steinberg. 
    It is commonly used by image manipulation software, for example when an image is 
    converted into GIF format that is restricted to a maximum of 256 colors. 
    ---
    See also https://en.wikipedia.org/wiki/Floyd%E2%80%93Steinberg_dithering .

    Inputs:
        FilePath: Absolute file path of an image.
        ResolutionX: Resolution frequency in the image x-direction.
            ---
            A lower value equals a higher resolution and thus longer processing times.
            For instance, a frequency of 1 selects each pixel of the original image,
            whereas a frequency of 2 reproduces only every second pixel and so fourth.
            For a rectangular image ResolutionX and ResolutionY should be adjusted
            manually to get an equal pixel distribution in both directions.
            For a square image both resolution inputs should be equal.
        ResolutionY: Resolution frequency in the image y-direction.
            ---
            A lower value equals a higher resolution and thus longer processing times.
            For instance, a frequency of 1 selects each pixel of the original image,
            whereas a frequency of 2 reproduces only every second pixel and so fourth.
            For a rectangular image ResolutionY and ResolutionX should be adjusted
            manually to get an equal pixel distribution in both directions.
            For a square image both resolution inputs should be equal.
        Factor: Quantization factor restricts the maximum number of colors.
    Output:
        Bounds: Boundary of the image as rectangle.
        Points: List of pixel positions.
        Colors: List of pixel colors."""


ghenv.Component.Name = "Pythonic Floyd-Steinberg Dithering"
ghenv.Component.NickName = "FSDither"

__author__ = "p1r4t3b0y"


from System.Drawing import Color, Bitmap
import Rhino.Geometry as rg


class FloydSteinbergDithering:
    """Floyd-Steinberg image dithering algorithm.

    Attributes:
        image: An image as instance of System.Drawing.Bitmap().
        resolution_x: An integer resolution frequency in the image x-direction.
        resolution_y: An integer resolution frequency in the image y-direction.
        factor: An integer quantization factor that restricts the maximum number of colors.
    """
    
    def __init__(self, image, resolution_x, resolution_y, factor):
        """Initialises the FloydSteinbergDithering class."""
        self.image = image
        self.width = image.Width
        self.height = image.Height
        self.resolution_x = resolution_x
        self.resolution_y = resolution_y
        self.factor = factor
        self.points = []
        self.pixels = []
      
        
    def _create_points(self):
        """Creates a nested list of 2-dimensional points for an image resolution in x- and y-direction."""  
        for y in reversed(range(self.height)):
            # reversed loop to match pixel order to prevent mirrored image display
            if y % self.resolution_y == 0:
                row_pts = []
                for x in range(self.width):
                    if x % self.resolution_x == 0:
                        row_pts.append(rg.Point2d(x, y))
                self.points.append(row_pts)
    
    
    def _create_pixels(self):
        """Creates a nested list of pixel colors for an image resolution in x- and y-direction."""  
        for y in range(self.height):
            if y % self.resolution_y == 0:
                row_pxls = []
                for x in range(self.width):
                    if x % self.resolution_x == 0:
                        row_pxls.append(image.GetPixel(x, y))
                self.pixels.append(row_pxls)
    
    
    def dither(self):
        """Achieves dithering of an image using error diffusion, meaning it pushes or adds the residual 
            quantization error of a pixel onto its neighboring pixels, to be dealt with later."""
        
        
        def restrict_rgb_value(value):
            """Restricts a color value to the RGB color bounds.
        
            Args:
              value: Integer color value.
            Returns:
              The color value between 0 and 255.
            """
            if value > 255:
                return 255
            elif value < 0:
                return 0
            else:
                return value
        
        
        # Initialise the points and pixels
        self._create_points()
        self._create_pixels() # colors
        
        for y in range(len(self.pixels) - 1): # for each y from top to bottom
            for x in range(1, len(self.pixels[y]) - 1): # for each x from left to right
                pix = self.pixels[y][x]
                
                # Get the initial color values
                init_a = pix.A # alpha value
                init_r = pix.R # red value
                init_g = pix.G # green value
                init_b = pix.B # blue value
                
                # Quantize the color values to a lower number of possibilities
                quant_r = int(round(int(self.factor) * init_r / 255)) * (255 / int(self.factor))
                quant_g = int(round(int(self.factor) * init_g / 255)) * (255 / int(self.factor))
                quant_b = int(round(int(self.factor) * init_b / 255)) * (255 / int(self.factor))
                self.pixels[y][x] = Color.FromArgb(init_a, quant_r, quant_g, quant_b)
                
                # Calculate error diffusion values
                err_r = init_r - quant_r
                err_g = init_g - quant_g
                err_b = init_b - quant_b
                
                # Dithering step 1
                r = restrict_rgb_value(self.pixels[y   ][x + 1].R + err_r * 7 / 16.0)
                g = restrict_rgb_value(self.pixels[y   ][x + 1].G + err_r * 7 / 16.0)
                b = restrict_rgb_value(self.pixels[y   ][x + 1].B + err_r * 7 / 16.0)
                self.pixels[y][x + 1] = Color.FromArgb(init_a, r, g, b)
                
                # Dithering step 2
                r = restrict_rgb_value(self.pixels[y + 1][x - 1].R + err_r * 3 / 16.0)
                g = restrict_rgb_value(self.pixels[y + 1][x - 1].G + err_r * 3 / 16.0)
                b = restrict_rgb_value(self.pixels[y + 1][x - 1].B + err_r * 3 / 16.0)
                self.pixels[y + 1][x - 1] = Color.FromArgb(init_a, r, g, b)
                
                # Dithering step 3
                r = restrict_rgb_value(self.pixels[y + 1][x   ].R + err_r * 5 / 16.0)
                g = restrict_rgb_value(self.pixels[y + 1][x   ].G + err_r * 5 / 16.0)
                b = restrict_rgb_value(self.pixels[y + 1][x   ].B + err_r * 5 / 16.0)
                self.pixels[y + 1][x   ] = Color.FromArgb(init_a, r, g, b)
                
                # Dithering step 4
                r = restrict_rgb_value(self.pixels[y + 1][x + 1].R + err_r * 1 / 16.0)
                g = restrict_rgb_value(self.pixels[y + 1][x + 1].G + err_r * 1 / 16.0)
                b = restrict_rgb_value(self.pixels[y + 1][x + 1].B + err_r * 1 / 16.0)
                self.pixels[y + 1][x + 1] = Color.FromArgb(init_a, r, g, b)
     
                            
    def get_points(self):
        """Returns a flat list of 2-dimensional points."""
        return [pt for lt in self.points for pt in lt]
    
    
    def get_pixels(self):
        """Returns a flat list of pixel colors."""
        return [px for lt in self.pixels for px in lt]
    
    
    def get_boundary(self):
        """Returns the image boundary as a rectangle."""
        origin = rg.Point3d(0, 0, 0)
        dir_x = rg.Vector3d(self.width, 0, 0)
        dir_y = rg.Vector3d(0, self.height, 0)
        plane = rg.Plane(origin, dir_x, dir_y)
        return rg.Rectangle3d(plane, self.width, self.height)


######################################################################################


if __name__ == "__main__":
    # Initialise image
    
    # Initialise and run FloydSteinbergDithering
    print ResolutionX
    fs = FloydSteinbergDithering(image, int(ResolutionX), int(ResolutionY), int(Factor))
    fs.dither()
    
    # Output result
    Bounds = fs.get_boundary()
    Points = fs.get_points()
    Colors = fs.get_pixels()
    
    # Display stats
    print "IMAGE STATS"
    if fs.width == fs.height: print " Type: Square"
    else: print " Type: Rectangle"
    print " Width: %d units" %(fs.width)
    print " Height: %d units" %(fs.height)
    print "\t"
    
    print "DITHERING STATS"
    print " Width: %d px" %(len(fs.pixels[0]))
    print " Height: %d px" %(len(fs.get_pixels()) / len(fs.pixels[0]))
    print " No. Pixels: %d px" %(len(fs.get_pixels()))
# ---------- end fsdither ----------
console = Panel(fsdither.out)
panel_7 = Panel(fsdither.Bounds)

panel_8 = Panel(item_3.Item)
python_3 = GhPythonScript(hex=panel_8)  # -> rgb
# ---------- python_3: Python ----------
__author__ = "Marco"
__version__ = "2022.11.23"

import rhinoscriptsyntax as rs
import System

a = tuple(int(hex[i:i+2], 16) for i in (0, 2, 4))

rgb = System.Drawing.Color.FromArgb(a[0], a[1], a[2])
# ---------- end python_3 ----------
division_2 = Division(A=num, B="48")
division_3 = Division(A=num_2, B="48")
points = Point(fsdither.Points)
division_4 = Division(A="385", B="48")
format_2 = Format(
    Format="Code {0} - {1}, HEX {2}, {3}",
    Culture=127,
    Data0=item_3.Item1,
    Data1=item_3.Item2,
    Data2=item_3.Item,
    Data3=python_3)
scale_nu = ScaleNU(Geometry=points, Plane=PlaneXY(0, 0, 0), ScaleX=division_4, ScaleY=division_4, ScaleZ=1)  # -> Geometry, Transform
legend_2 = Legend(Colour=python_3, Tags=format_2, LegendType=1)
data = Data(division_2)
points_2 = Point(scale_nu.Geometry)
colors = Colour(fsdither.Colors)
python_4 = GhPythonScript(points=points_2)  # -> rtree; inputs points: list of Point3d
# ---------- python_4: Python ----------
__author__ = "Marco"
__version__ = "2022.11.26"

import rhinoscriptsyntax as rs
import Rhino.Geometry as rg


rtree = rg.RTree.CreateFromPointArray(points)
# ---------- end python_4 ----------
python_5 = GhPythonScript(file_path=imagepath)  # -> out, filename; disabled
# ---------- python_5: Python ----------
__author__ = "Marco"
__version__ = "2022.12.04"

import rhinoscriptsyntax as rs
import os

import os

file_name = os.path.basename(file_path)
tempTuple = os.path.splitext(file_name)
filename = tempTuple[0]
# ---------- end python_5 ----------
panel_9 = Panel("Output\")  # disabled
number_slider = Slider(11, range=0..11)  # disabled
data_2 = Data(python_5.filename)  # disabled
concat = Concatenate(FragmentA=panel_9, FragmentB=data_2)  # disabled
panel_10 = Panel("48")  # disabled
panel_11 = Panel("48")  # disabled
panel_12 = Panel("8")  # disabled
panel_13 = Panel(",")  # disabled
path_mapper = PathMapper()  # disabled
row = Slider(0, range=0..47)  # disabled
column = Slider(0, range=0..5)  # disabled
panel_14 = Panel("instruction_Plate_{0}.csv")  # disabled
concat_2 = Concatenate(FragmentA=concat, FragmentB=panel_14, JoinSeparator="\")  # disabled
panel_15 = Panel("1000,1000,1000")  # disabled

toggle_2 = BooleanToggle(False)  # disabled
toggle_3 = BooleanToggle(True)  # disabled
toggle_4 = BooleanToggle(True)  # disabled
swatch = ColourSwatch(SwatchColor=RGB(217, 217, 217))  # disabled
number_slider_2 = Slider(2, range=0..10)  # disabled
panel_16 = Panel("10")  # disabled
number_slider_3 = Slider(0.5, range=0..1)  # disabled
cubemaps = CubeMaps(Index=4, Intensity=number_slider_2)  # disabled
directional_light = DirectionalLight(Color=RGB(255, 255, 255), Position=panel_15, Target=Point(0, 0, 0), Intensity=1)  # disabled
envmap = EnvironmentMap(BackgroundColor=swatch, Bitmap=cubemaps, IsBackground=toggle_2, IsEnvironment=toggle_3, IsIllumination=toggle_4)  # disabled
shadows = AddShadows(Light=directional_light, Samples=panel_16, Threshold=number_slider_3)  # disabled

# ----
# Lego Piece
mesh = Mesh(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)
mesh_2 = Mesh([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])
mjoin = MeshJoin(Meshes=mesh)

mjoin_2 = MeshJoin(Meshes=mesh_2)
scale_nu_2 = ScaleNU(Geometry=mjoin_2, Plane=PlaneXY(0, 0, 0), ScaleX="0.975", ScaleY="0.975", ScaleZ=1)  # -> Geometry, Transform
orient = Orient(Geometry=mjoin_2, Source=PlaneXY(0, 0, 0), Target=scale_nu.Geometry)  # -> flatten(Geometry), Transform

orient_2 = Orient(Geometry=scale_nu_2.Geometry, Source=PlaneXY(0, 0, 0), Target=scale_nu.Geometry)  # -> flatten(Geometry), Transform

orient_3 = Orient(Geometry=mjoin_2, Source=PlaneXY(0, 0, 0), Target=scale_nu.Geometry)  # -> flatten(Geometry), Transform
bbox = BoundingBox(Content=orient.Geometry, Plane=PlaneXY(0, 0, 0), UnionBox=True)  # -> Box, Box_2
bbox_2 = BoundingBox(Content=orient_3.Geometry, Plane=PlaneXY(0, 0, 0), UnionBox=True)  # -> Box, Box_2
debrep = DeconstructBrep(Brep=bbox.Box)  # -> Faces, Edges, Vertices
debrep_2 = DeconstructBrep(Brep=bbox_2.Box)  # -> Faces, Edges, Vertices
area = Area(Geometry=debrep.Faces)  # -> Area, Centroid
area_2 = Area(Geometry=debrep_2.Faces)  # -> Area, Centroid
pdecon = Deconstruct(Point=area.Centroid)  # -> XComponent, YComponent, ZComponent
pdecon_2 = Deconstruct(Point=area_2.Centroid)  # -> XComponent, YComponent, ZComponent
sort = SortList(Keys=pdecon.ZComponent, ValuesA=debrep.Faces)  # -> Keys, ValuesA
sort_2 = SortList(Keys=pdecon_2.ZComponent, ValuesA=debrep_2.Faces)  # -> Keys, ValuesA
item_4 = ListItem(List=sort.ValuesA, Index=0, Wrap=True)
item_5 = ListItem(List=sort_2.ValuesA, Index=0, Wrap=True)
srf = Surface(item_4)
divide = DivideDomain²(Domain=srf, UCount=division_3, VCount=data)
subsrf = Isotrim(Surface=srf, Domain=divide)
mplane = MeshPlane(Boundary=subsrf, WidthCount="48", HeightCount="48")  # -> Mesh, Area
facen = FaceNormals(Mesh=mplane.Mesh)  # -> Centers, Normals
python_6 = GhPythonScript(rtree=python_4, y=facen.Centers)  # -> out, simplify(indexes); inputs y: Point3d
# ---------- python_6: Python ----------
__author__ = "Marco"
__version__ = "2022.11.26"

import rhinoscriptsyntax as rs
import Rhino.Geometry as rg

indexes = []
def SearchCallback(sender, e):

    e.SearchSphere = rg.Sphere(y, 0.1)
    indexes.append( e.Id )

sphere = rg.Sphere( y, 0.1 )

rtree.Search(sphere, SearchCallback)
# ---------- end python_6 ----------
shift = ShiftPaths(Data=python_6.indexes, Offset=-1)
item_6 = ListItem(List=colors, Index=shift, Wrap=True)

# ----
# Get Closest Colors
colors_2 = Colour(item_6)
list_3 = ValueList({"rgb": 0, "hsv": 1}, selected="rgb")
col = Colour(python_3)
argb = SplitARGB(Colour=colors_2)  # -> Alpha, Red, Green, Blue
argb_2 = SplitARGB(Colour=col)  # -> Alpha, Red, Green, Blue
python_7 = GhPythonScript(x=argb_2.Red, y=argb_2.Green, z=argb_2.Blue)  # -> out, a, b, c
# ---------- python_7: Python ----------
__author__ = "Marco"
__version__ = "2022.11.19"

import rhinoscriptsyntax as rs

def rgb_to_hsv(r, g, b):
    r = float(r)
    g = float(g)
    b = float(b)
    high = max(r, g, b)
    low = min(r, g, b)
    h, s, v = high, high, high

    d = high - low
    s = 0 if high == 0 else d/high

    if high == low:
        h = 0.0
    else:
        h = {
            r: (g - b) / d + (6 if g < b else 0),
            g: (b - r) / d + 2,
            b: (r - g) / d + 4,
        }[high]
        h /= 6

    return h, s, v

a,b,c = rgb_to_hsv(x,y,z)
# ---------- end python_7 ----------
python_8 = GhPythonScript(x=argb.Red, y=argb.Green, z=argb.Blue)  # -> out, a, b, c; same code as python_7
pt = ConstructPoint(XCoordinate=argb_2.Red, YCoordinate=argb_2.Green, ZCoordinate=argb_2.Blue)
pt_2 = ConstructPoint(XCoordinate=python_7.a, YCoordinate=python_7.b, ZCoordinate=python_7.c)
pt_3 = ConstructPoint(XCoordinate=argb.Red, YCoordinate=argb.Green, ZCoordinate=argb.Blue)
pt_4 = ConstructPoint(XCoordinate=python_8.a, YCoordinate=python_8.b, ZCoordinate=python_8.c)
filter = StreamFilter(Gate=list_3, Stream0=pt_3, Stream1=pt_4)
filter_2 = StreamFilter(Gate=list_3, Stream0=pt, Stream1=pt_2)
cp = ClosestPoint(Point=filter, Cloud=filter_2)  # -> ClosestPoint, CPIndex, Distance
item_7 = ListItem(List=filter_2, Index=cp.CPIndex, Wrap=True)
col_2 = Colour(item_7)

item_8 = ListItem(List=orient_2.Geometry, Index=shift, Wrap=True)
item_9 = ListItem(List=orient_2.Transform, Index=shift, Wrap=True)
python_9 = GhPythonScript(x=col_2)  # -> out, a; inputs x: Color
# ---------- python_9: Python ----------
__author__ = "Marco"
__version__ = "2022.12.01"

import rhinoscriptsyntax as rs
import System.Drawing.Color

if x == System.Drawing.Color.FromArgb(0,0,0):
    a = System.Drawing.Color.White
else:
    a = x
# ---------- end python_9 ----------
graft = GraftTree(Tree=item_8, IncludeEmptyLists=True, IncludeNullItems=True)
graft_2 = GraftTree(Tree=col_2, IncludeEmptyLists=True, IncludeNullItems=True)

python_10 = GhPythonScript(rgb=col_2)  # -> hex; disabled
# ---------- python_10: Python ----------
__author__ = "Marco"
__version__ = "2022.11.23"

import rhinoscriptsyntax as rs

def rgb_to_hex(r, g, b):
  return ('{:X2}{:X2}{:X2}').format(r, g, b)

hex = rgb_to_hex(rgb.R, rgb.G, rgb.B)
# ---------- end python_10 ----------
item_10 = ListItem(List=split_2, Index=0, Wrap=True)  # -> flatten(Item), flatten(Item1), flatten(Item2); disabled
txt = Text(flatten(python_10))  # disabled
txt_2 = Text(item_10.Item)  # disabled
mindex = MemberIndex(Set=txt, Member=txt_2)  # -> simplify(Index), Count; disabled
python_11 = GhPythonScript(hex=item_10.Item)  # -> rgb; disabled; same code as python_3
clean = CleanTree(RemoveNulls=True, RemoveInvalid=True, RemoveEmpty=invert(False), Tree=simplify(mindex.Index))  # disabled
graft_3 = GraftTree(Tree=python_11, IncludeEmptyLists=True, IncludeNullItems=True)  # disabled
graft_4 = GraftTree(Tree=item_10.Item1, IncludeEmptyLists=True, IncludeNullItems=True)  # disabled
graft_5 = GraftTree(Tree=item_10.Item2, IncludeEmptyLists=True, IncludeNullItems=True)  # disabled
lng = ListLength(List=mindex.Index)  # disabled
tstat = TreeStatistics(Tree=clean)  # -> Paths, Length, Count; disabled
branch = TreeBranch(Tree=simplify(graft_3), Path=tstat.Paths, MaintainPaths=True)  # -> flatten(Branch); disabled
branch_2 = TreeBranch(Tree=simplify(graft_4), Path=tstat.Paths, MaintainPaths=True)  # -> flatten(Branch); disabled
branch_3 = TreeBranch(Tree=simplify(graft_5), Path=tstat.Paths, MaintainPaths=True)  # -> flatten(Branch); disabled
branch_4 = TreeBranch(Tree=simplify(lng), Path=tstat.Paths, MaintainPaths=True)  # -> flatten(Branch); disabled
sort_3 = SortList(Keys=branch_4, ValuesA=branch_3, ValuesB=branch_2, ValuesC=branch)  # -> reverse(Keys), reverse(ValuesA), reverse(ValuesB), reverse(ValuesC); disabled
panel_17 = Panel("{0}-{1}-{2}")  # disabled
panel_18 = Panel("Code {0}-{1}-n° pieces: {2}")  # disabled
format_3 = Format(Format=panel_17, Culture=127, Data0=sort_3.ValuesB, Data1=sort_3.ValuesA, Data2=sort_3.Keys)  # disabled
format_4 = Format(Format=panel_18, Culture=127, Data0=sort_3.ValuesB, Data1=sort_3.ValuesA, Data2=sort_3.Keys)  # disabled
panel_19 = Panel("Code, Color, Pieces")  # disabled
legend_3 = Legend(Colour=sort_3.ValuesC, Tags=format_4, LegendType=1)  # disabled
merge = Merge(Data1=panel_19, Data2=format_3)  # disabled
panel_20 = Panel("ORDER.csv")  # disabled

flatten_tree = FlattenTree(Tree=graft, Path="{0}")  # disabled
flatten_tree_2 = FlattenTree(Tree=graft_2, Path="{0}")  # disabled
phong_material = PhongMaterial(ModelElement=flatten_tree, Color=flatten_tree_2, Shininess=1)  # disabled
c_script_2 = CSharpScript()  # -> A; disabled
# ---------- c_script_2: C# ----------
A = System.IO.Path.GetDirectoryName(owner.OnPingDocument().FilePath);
# ---------- end c_script_2 ----------
merge_2 = Merge(Data1=phong_material, Data3=envmap, Data5=shadows)  # -> flatten(Result); disabled
panel_21 = Panel(c_script_2)  # disabled
panel_22 = Panel("Venere")  # disabled
toggle_5 = BooleanToggle(False)  # disabled
scene = AssembleScene(SceneObjects=flatten(merge_2), ClickModes=0)  # disabled
savehtml = SaveHtml(Scene=scene, FolderPath=panel_21, FolderName=panel_22, Local=0, Save=toggle_5)  # -> HtmlPath, JavascriptPath; disabled

data_3 = Data(flatten(item_8))  # disabled
item_11 = ListItem(List=data_3, Index=mindex.Index, Wrap=True)  # disabled
mesh_3 = Mesh(item_11)  # disabled

data_4 = Data(flatten(col_2))  # disabled
ma = MassAddition(Input=sort_3.Keys)  # -> Result, PartialResults; disabled
item_12 = ListItem(List=data_4, Index=mindex.Index, Wrap=True)  # disabled
gltf2material = GlTF20Material(
    BaseColorFactor=python_11,
    MetallicFactor=0,
    RoughnessFactor=1,
    EmissiveFactor=RGB(0, 0, 0),
    AlphaMode="OPAQUE",
    AlphaCutoff=0.5,
    DoubleSided=True)  # disabled
concat_3 = Concatenate(FragmentA=concat, FragmentB=panel_20, JoinSeparator="\")  # disabled

# ----
# Export
txt_3 = Text(merge)  # disabled
python_12 = GhPythonScript(text=txt_3, name=concat_3, save=toggle)  # -> out, a; inputs text: list, save: Boolean; disabled
# ---------- python_12: Python ----------
__author__ = "Marco"
__version__ = "2022.11.26"

import rhinoscriptsyntax as rs
import os
import io

os.chdir( rs.DocumentPath() )

# Check whether the specified path exists or not
directory = os.path.dirname(name)
isExist = os.path.exists(directory)
if not isExist:

   # Create a new directory because it does not exist
   os.makedirs(directory)


newText = []
for line in text:
    newText.append( line.replace("-", ",") )


with io.open(name, "w", encoding='utf-8') as f:
    f.writelines('\n'.join(newText))
# ---------- end python_12 ----------

gltfdisplay = GlTF20Display(Geometry=mesh_3, Material=gltf2material)  # disabled

# ----
# Visualisation
mcol = MeshColours(Mesh=graft, Colours=graft_2)

shift_2 = ShiftPaths(Data=simplify(mcol), Offset=-1)
mjoin_3 = MeshJoin(Meshes=flatten(shift_2))

mesh_4 = Mesh(mjoin_3)
preview = CustomPreview(
    Geometry=mesh_4,
    Material={diffuse=RGB(221, 160, 221), emission=RGB(66, 48, 66), shine=0.5, specular=RGB(255, 255, 255), transparency=0})

demesh = DeconstructMesh(Mesh=shift_2)  # -> Vertices, Faces, Colours, Normals; disabled
item_13 = ListItem(List=demesh.Colours, Index=0, Wrap=True)  # disabled
data_5 = Data(shift_2)  # disabled
python_13 = GhPythonScript(rgb=item_13)  # -> hex; disabled; same code as python_10
branch_5 = TreeBranch(Tree=data_5, Path=number_slider, MaintainPaths=True)  # disabled
shift_3 = ShiftPaths(Data=simplify(python_13), Offset=-1)  # disabled
geometry = Geometry(branch_5)  # disabled
partition = PartitionList(List=shift_3, Size=panel_11)  # -> simplify(Chunks); disabled
partition_list = PartitionList(List=geometry, Size=panel_10)  # -> simplify(Chunks); disabled
panel_23 = Panel(partition)  # disabled
partition_list_2 = PartitionList(List=partition_list, Size=panel_12)  # disabled
txt_4 = Text(panel_23)  # disabled
join = TextJoin(Text=txt_4, Join=panel_13)  # disabled
shift_4 = ShiftPaths(Data=simplify(join), Offset=-1)  # disabled
tstat_2 = TreeStatistics(Tree=shift_4)  # -> Paths, Length, Count; disabled
ghpython_script = GhPythonScript(tree=partition_list_2, row=row, column=column)  # -> out, a; inputs tree: tree, row: Int32, column: Int32; disabled
# ---------- ghpython_script: Python ----------
__author__ = "Marco"
__version__ = "2022.12.25"

import rhinoscriptsyntax as rs
import Grasshopper as gh

gh_path = gh.Kernel.Data.GH_Path(row,column)

a = tree.Branch(gh_path)
# ---------- end ghpython_script ----------
format_5 = Format(Format=concat_2, Culture=127, Data0=tstat_2.Paths)  # disabled
graft_6 = GraftTree(Tree=format_5, IncludeEmptyLists=True, IncludeNullItems=True)  # disabled

# ----
# Export
txt_5 = Text(shift_4)  # disabled
python_14 = GhPythonScript(text=txt_5, name=graft_6, save=toggle)  # -> out, file_path; inputs text: list, save: Boolean; disabled
# ---------- python_14: Python ----------
__author__ = "Marco"
__version__ = "2022.11.26"

import rhinoscriptsyntax as rs
import os
import io

os.chdir( rs.DocumentPath() )

# Check whether the specified path exists or not
directory = os.path.dirname(name)
isExist = os.path.exists(directory)
if not isExist:

   # Create a new directory because it does not exist
   os.makedirs(directory)
   print("The new directory is created!")


if save:
    with io.open(name, "w", encoding='utf-8') as f:
        f.writelines('\n'.join(text))

file_path = name
# ---------- end python_14 ----------

panel_24 = Panel(python_14.file_path)  # disabled
