# Grasshopper definition legoPaint_v3.gh (Grasshopper 1.0.7)
# plug-ins: Noise, MeshEdit Components, treesloth01, LunchBoxML, EleFront

number_slider = Slider(2, range=2..6)
mm = Panel("385")
sqgrid = Square(Plane=PlaneXY(0, 0, 0), Size=mm, ExtentX="2", ExtentY="2")  # -> Cells, Points
crv = Curve(sqgrid.Cells)
mplane = MeshPlane(Boundary=crv, WidthCount="48", HeightCount="48")  # -> Mesh, Area
mesh_join = MeshJoin(Meshes=flatten(mplane.Mesh))
face_normals = FaceNormals(Mesh=mplane.Mesh)  # -> flatten(Centers), Normals
pt = Point(face_normals.Centers)
pdecon = Deconstruct(Point=pt)  # -> XComponent, YComponent, ZComponent
bnd = Bounds(Numbers=pdecon.XComponent)
bnd_2 = Bounds(Numbers=pdecon.YComponent)
remap = RemapNumbers(Value=pdecon.XComponent, Source=bnd, Target=Domain(0, 1))  # -> Mapped, Clipped
remap_2 = RemapNumbers(Value=pdecon.YComponent, Source=bnd_2, Target=Domain(0, 1))  # -> Mapped, Clipped
vec = VectorXYZ(XComponent=remap.Mapped, YComponent=remap_2.Mapped, ZComponent=0)  # -> Vector, Length
ghpython_script = GhPythonScript()  # -> out, r, g, b
# ---------- ghpython_script: Python ----------
colors =    {1:"124,92,66",
             2: "126,156,134",
             3: "102,43,50",
             4:  "80,44,25",
             5: "147,148,147",
             6: "101,101,101",
             7: "209,130,60",
             8: "83,161,90",
             9: "174,37,26",
             10: "130,95,154",
             11: "42,60,99",
             12: "237,199,67",
             13: "53,96,171",
             14: "176,163,118",
             15: "76,76,76",
             16: "215,215,215",
             17: "133,79,53",
             18: "164,182,215",
             19: "233,184,154",
             20: "58,81,61",
             21: "72,126,167",
             22: "159,188,83",
             23: "87,68,141",
             24: "198,68,156",
             25: "65,137,133",
             26: "61,47,21",
             27: "108,156,180",
             28: "132,64,120",
             29: "185,205,200",
             30: "248,226,129",
             31: "103,108,55",
             32: "228,154,197",
             33: "228,162,68"}

keys = colors.keys()

r = []
g = []
b = []

for i in keys:
    a = colors[i]

    items = a.split(",")

    r.append( items[0] )
    g.append( items[1] )
    b.append( items[2] )
# ---------- end ghpython_script ----------
mesh_explode = MeshExplode(Mesh=mesh_join, Interpolate=False)
image = ImageSampler(
    vec.Vector,
    FilePath="C:\GitHub\qr-art.github.io\LegoPaint\photos\photography-exhibition-icons-steve-mccurry-florence-940x628.jpeg",
    Filter="Colour",
    Interpolate=False,
    Umax=1,
    Umin=0,
    Vmax=1,
    Vmin=0,
    Wrap=1)
colour_rgb = ColourRGB(Alpha=255, Red=ghpython_script.r, Green=ghpython_script.g, Blue=ghpython_script.b)

# ----
# Perlin Noise 2d
number_slider_2 = Slider(-0.36, range=-0.5..0.5)
number_slider_3 = Slider(1.8, range=1..10)
vector_xyz = VectorXYZ(XComponent=number_slider_2, YComponent=Slider(-0.26, range=-0.5..0.5), ZComponent=0)  # -> Vector, Length
number_slider_4 = Slider(4, range=1..5)
perlinnoise = PerlinNoise(
    Points=face_normals.Centers,
    Seed=0,
    Amplitude=1,
    SmoothStep=0,
    FrequecyX=number_slider_3,
    FrequecyY=number_slider_3,
    FrequecyZ=number_slider_3,
    Jitter=Slider(0.59, range=-1..1),
    AlignVector=vector_xyz.Vector)
pi = Pi(Factor=1)
panel = Panel("1")
multiplication = Multiplication(A=perlinnoise, B=pi, C=Slider(7.18, range=0..10))
sine = Sine(Value=multiplication)

image_2 = ImageSampler(
    vec.Vector,
    FilePath="C:\GitHub\qr-art.github.io\LegoPaint\photos\[removal.ai]_tmp-634dbdb1cbc40.png",
    Filter="Colour",
    Interpolate=False,
    Umax=1,
    Umin=0,
    Vmax=1,
    Vmin=0,
    Wrap=1)
list_length = ListLength(List=colour_rgb)
series = Series(Start=0, Step=1, Count=list_length)
legend = Legend(Colour=colour_rgb, Tags=series, LegendType=1)
panel_2 = Panel("""10
11
12""")
panel_3 = Panel("""8
11
7
20""")
panel_4 = Panel("""21
22
23""")
panel_5 = Panel("""26
27
28
29
15
31
32""")
list_item = ListItem(List=colour_rgb, Index=panel_2, Wrap=True)
list_item_2 = ListItem(List=colour_rgb, Index=panel_3, Wrap=True)
list_item_3 = ListItem(List=colour_rgb, Index=panel_5, Wrap=True)
list_item_4 = ListItem(List=colour_rgb, Index=panel_4, Wrap=True)
entwine = Entwine(
    Branch00=ColourSwatch(SwatchColor=RGB(255, 135, 0)),
    Branch01=ColourSwatch(SwatchColor=RGB(255, 202, 0)),
    Branch02=ColourSwatch(SwatchColor=RGB(255, 44, 0)),
    FlattenInputs=True)
entwine_2 = Entwine(
    Branch00=ColourSwatch(SwatchColor=RGB(59, 59, 59)),
    Branch01=ColourSwatch(SwatchColor=RGB(128, 128, 128)),
    Branch02=ColourSwatch(SwatchColor=RGB(217, 217, 217)),
    Branch03=ColourSwatch(SwatchColor=RGB(255, 255, 255)),
    FlattenInputs=True)
graft_tree = GraftTree(Tree=list_item, IncludeEmptyLists=True, IncludeNullItems=True)
graft = GraftTree(Tree=list_item_3, IncludeEmptyLists=True, IncludeNullItems=True)
graft_tree_2 = GraftTree(Tree=list_item_2, IncludeEmptyLists=True, IncludeNullItems=True)
graft_tree_3 = GraftTree(Tree=list_item_4, IncludeEmptyLists=True, IncludeNullItems=True)
entwine_3 = Entwine(
    Branch0X=entwine,
    Branch1X=entwine_2,
    Branch2X=graft_tree,
    Branch3X=graft_tree_2,
    Branch4X=graft_tree_3,
    Branch5X=graft,
    FlattenInputs=False)  # -> simplify(Result)
ghpython_script_2 = GhPythonScript()  # -> out, r, g, b; same code as ghpython_script
swatch = ColourSwatch(SwatchColor=RGB(255, 0, 0))
argb = SplitARGB(Colour=image)  # -> Alpha, Red, Green, Blue
data = Data(graft)
colour_rgb_2 = ColourRGB(Alpha=255, Red=ghpython_script_2.r, Green=ghpython_script_2.g, Blue=ghpython_script_2.b)
python = GhPythonScript(x=ColourSwatch(SwatchColor=RGB(161, 84, 136)))  # -> out, r, g, b
# ---------- python: Python ----------
__author__ = "Marco"
__version__ = "2022.10.16"

import rhinoscriptsyntax as rs

r = x.R
g = x.G
b = x.B
# ---------- end python ----------
entwine_4 = Entwine(Branch00=argb.Red, Branch01=argb.Green, Branch02=argb.Blue, FlattenInputs=True)
shift = ShiftPaths(Data=data, Offset=-1)
pt_2 = ConstructPoint(XCoordinate=ghpython_script_2.r, YCoordinate=ghpython_script_2.g, ZCoordinate=ghpython_script_2.b)
pt_3 = ConstructPoint(XCoordinate=python.r, YCoordinate=python.g, ZCoordinate=python.b)
flip = FlipMatrix(Data=entwine_4)  # -> simplify(Data)
lng = ListLength(List=shift)  # -> flatten(Length)
inblock = InsertBlock(BlockName="1 stub mesh", SourcePlane=PlaneXY(0, 0, 0))
demesh = DeconstructMesh(Mesh=mesh_explode)  # -> Vertices, Faces, Colours, Normals
cp = ClosestPoint(Point=pt_3, Cloud=pt_2)  # -> ClosestPoint, CPIndex, Distance
k_means = KMeansClustering(TrainingInputs=flip, OfClusters=lng, RandomSeed=5)  # -> Result, Likelihood, Centroids
deblock = DeconstructBlock(Block=inblock)  # -> Name, Plane, Geometry
item = ListItem(List=demesh.Vertices, Index=0, Wrap=True)
item_2 = ListItem(List=colour_rgb_2, Index=cp.CPIndex, Wrap=True)
mjoin = MeshJoin(Meshes=deblock.Geometry)
xy = XYPlane(Origin=item)
concat = Concatenate(FragmentA=cp.CPIndex, FragmentB=item_2, JoinSeparator=" -")
cset = CreateSet(List=k_means.Result)  # -> Set, Map
list_length_2 = ListLength(List=colour_rgb_2)
mindex = MemberIndex(Set=k_means.Result, Member=cset.Set)  # -> simplify(Index), Count
orient = Orient(Geometry=mjoin, Source=PlaneXY(0, 0, 0), Target=xy)  # -> flatten(Geometry), Transform
legend_2 = Legend(Colour=item_2, Tags=concat, LegendType=1)
series_2 = Series(Start=0, Step=1, Count=list_length_2)
concat_2 = Concatenate(FragmentA=series_2, FragmentB=colour_rgb_2, JoinSeparator=" -")
list_item_5 = ListItem(List=orient.Geometry, Index=mindex.Index, Wrap=True)
legend_3 = Legend(Colour=colour_rgb_2, Tags=concat_2, LegendType=1)
mesh_colours = MeshColours(Mesh=list_item_5, Colours=data)
list = ValueList({"preview": 0, "lego brick": 1}, selected="lego brick")
filter = StreamFilter(Gate=list, Stream1=mesh_colours)
shift_2 = ShiftPaths(Data=simplify(filter), Offset=-1)
mesh_join_2 = MeshJoin(Meshes=shift_2)
tstat = TreeStatistics(Tree=mesh_join_2)  # -> Paths, Length, Count
multiplication_2 = Multiplication(A=mm, B=1.15)
multiplication_3 = Multiplication(A=mm, B="2", C="2")
sqrt = SquareRoot(Value=tstat.Count)
round = Round(Number=sqrt)  # -> Nearest, Floor, Ceiling
sqgrid_2 = Square(Plane=PlaneXY(0, 0, 0), Size=multiplication_3, ExtentX=round.Ceiling, ExtentY=round.Ceiling)  # -> flatten(Cells), Points
mjoin_2 = MeshJoin(Meshes=flatten(mplane.Mesh))
split = SplitList(List=sqgrid_2.Cells, Index=tstat.Count)  # -> ListA, ListB
area = Area(Geometry=split.ListA)  # -> Area, Centroid
area_2 = MeshArea(Mesh=mjoin_2)  # -> Area, flatten(Centroid)
subtraction = Subtraction(A=area.Centroid, B=area_2.Centroid)
move = Move(Geometry=flatten(mesh_join_2), Motion=subtraction)  # -> Geometry, Transform

meshcolored = Data(filter)
curve = Curve(flatten(crv))
param_viewer = ParamViewer(meshcolored)
jitter = Jitter(List=param_viewer, Jitter=1, Seed=Slider(14, range=0..20))  # -> Values, Indices
tree_branch = TreeBranch(Tree=meshcolored, Path=jitter.Values, MaintainPaths=False)
cluster = Data(tree_branch)
ghpython_script_3 = GhPythonScript(Cluster=cluster, iCurve=curve, platePrice="8.99", brickPrice="0.06")  # -> out, totalCost; inputs Cluster: tree of Mesh, iCurve: list of Curve
# ---------- ghpython_script_3: Python ----------
__author__ = "mpmac"

import rhinoscriptsyntax as rs


number_of_tree = Cluster.BranchCount
for i in range(number_of_tree):
    value = Cluster.Branch(i).Count
    print "Cluster {0}: {1:4} pcs".format(i+1,value)

number_of_brick = Cluster.DataCount

brickCost = number_of_brick * brickPrice

number_of_plate = len(iCurve)
plateCost = number_of_plate * platePrice

totalCost = brickCost + plateCost

print "Number of Brick: {0:4}".format(number_of_brick)
print "Number of Plate: {0:4}".format(number_of_plate)
print "Bricks Cost: {0:6} €".format(brickCost)
print "Plates Cost: {0:6} €".format(plateCost)
print "--------------------"
print "Total Cost:  {0:6} €".format(totalCost)
# ---------- end ghpython_script_3 ----------
panel_6 = Panel(ghpython_script_3.totalCost)
panel_7 = Panel(ghpython_script_3.out)

preview = CustomPreview(
    Geometry=move.Geometry,
    Material={diffuse=RGB(221, 160, 221), emission=RGB(66, 48, 66), shine=0.5, specular=RGB(255, 255, 255), transparency=0})
