# Grasshopper definition legoPaint_v5_diethering.gh (Grasshopper 1.0.7)
# plug-ins: EleFront, ghgl

ghpython_script = GhPythonScript()  # -> out, r, g, b
# ---------- ghpython_script: Python ----------
colors =    {1:"124,92,66",
             2: "126,156,134",
             3: "102,43,50",
             4:  "80,44,25",
             5: "147,148,147",
             6: "101,101,101",
             7: "209,130,60",
             8: "83,161,90",
             9: "174,37,26",
             10: "130,95,154",
             11: "42,60,99",
             12: "237,199,67",
             13: "53,96,171",
             14: "176,163,118",
             15: "76,76,76",
             16: "215,215,215",
             17: "133,79,53",
             18: "164,182,215",
             19: "233,184,154",
             20: "58,81,61",
             21: "72,126,167",
             22: "159,188,83",
             23: "87,68,141",
             24: "198,68,156",
             25: "65,137,133",
             26: "61,47,21",
             27: "108,156,180",
             28: "132,64,120",
             29: "185,205,200",
             30: "248,226,129",
             31: "103,108,55",
             32: "228,154,197",
             33: "228,162,68",
             34: "5,5,5",
             35: "255,255,255"}

keys = colors.keys()

r = []
g = []
b = []

for i in keys:
    a = colors[i]

    items = a.split(",")

    r.append( items[0] )
    g.append( items[1] )
    b.append( items[2] )
# ---------- end ghpython_script ----------
colour_rgb = ColourRGB(Alpha=255, Red=ghpython_script.r, Green=ghpython_script.g, Blue=ghpython_script.b)
col = Colour(colour_rgb)
lng = ListLength(List=col)
series = Series(Start=0, Step=1, Count=lng)
concat = Concatenate(FragmentA=series, FragmentB=col, JoinSeparator=" -")
legend = Legend(Colour=col, Tags=concat, LegendType=1)

imagepath = FilePath("C:\GitHub\qr-art.github.io\LegoPaint\photos\abstract_square.jpg")
image_resource = ImageResource(imagepath)
data = Data(image_resource)
python = GhPythonScript(FilePath=data)  # -> out, image, resolution_x, resolution_y
# ---------- python: Python ----------
__author__ = "Marco"
__version__ = "2022.11.19"

import rhinoscriptsyntax as rs
from System.Drawing import Color, Bitmap
import Rhino.Geometry as rg

image = Bitmap(FilePath)
resolution_x = image.Width
resolution_y = image.Height
# ---------- end python ----------

# ----
# Controls
panel = Panel("96")
quantizationfactor = Slider(200, range=1..201)

panel_2 = Panel("2")
division = Division(A=python.resolution_x, B=panel)
division_2 = Division(A=python.resolution_y, B=panel)
round = Round(Number=division)  # -> Nearest, Floor, Ceiling
round_2 = Round(Number=division_2)  # -> Nearest, Floor, Ceiling

fsdither = PythonicFloydSteinbergDithering(image=python.image, ResolutionX=round.Ceiling, ResolutionY=round_2.Ceiling, Factor=quantizationfactor)  # -> out, Bounds, Points, Colors
# ---------- fsdither: Python ----------
"""Pythonic Floyd-Steinberg Image Dithering Algorithm.
    ---
    The algorithm was first published in 1976 by Robert W. Floyd and Louis Steinberg. 
    It is commonly used by image manipulation software, for example when an image is 
    converted into GIF format that is restricted to a maximum of 256 colors. 
    ---
    See also https://en.wikipedia.org/wiki/Floyd%E2%80%93Steinberg_dithering .

    Inputs:
        FilePath: Absolute file path of an image.
        ResolutionX: Resolution frequency in the image x-direction.
            ---
            A lower value equals a higher resolution and thus longer processing times.
            For instance, a frequency of 1 selects each pixel of the original image,
            whereas a frequency of 2 reproduces only every second pixel and so fourth.
            For a rectangular image ResolutionX and ResolutionY should be adjusted
            manually to get an equal pixel distribution in both directions.
            For a square image both resolution inputs should be equal.
        ResolutionY: Resolution frequency in the image y-direction.
            ---
            A lower value equals a higher resolution and thus longer processing times.
            For instance, a frequency of 1 selects each pixel of the original image,
            whereas a frequency of 2 reproduces only every second pixel and so fourth.
            For a rectangular image ResolutionY and ResolutionX should be adjusted
            manually to get an equal pixel distribution in both directions.
            For a square image both resolution inputs should be equal.
        Factor: Quantization factor restricts the maximum number of colors.
    Output:
        Bounds: Boundary of the image as rectangle.
        Points: List of pixel positions.
        Colors: List of pixel colors."""


ghenv.Component.Name = "Pythonic Floyd-Steinberg Dithering"
ghenv.Component.NickName = "FSDither"

__author__ = "p1r4t3b0y"


from System.Drawing import Color, Bitmap
import Rhino.Geometry as rg


class FloydSteinbergDithering:
    """Floyd-Steinberg image dithering algorithm.

    Attributes:
        image: An image as instance of System.Drawing.Bitmap().
        resolution_x: An integer resolution frequency in the image x-direction.
        resolution_y: An integer resolution frequency in the image y-direction.
        factor: An integer quantization factor that restricts the maximum number of colors.
    """
    
    def __init__(self, image, resolution_x, resolution_y, factor):
        """Initialises the FloydSteinbergDithering class."""
        self.image = image
        self.width = image.Width
        self.height = image.Height
        self.resolution_x = resolution_x
        self.resolution_y = resolution_y
        self.factor = factor
        self.points = []
        self.pixels = []
      
        
    def _create_points(self):
        """Creates a nested list of 2-dimensional points for an image resolution in x- and y-direction."""  
        for y in reversed(range(self.height)):
            # reversed loop to match pixel order to prevent mirrored image display
            if y % self.resolution_y == 0:
                row_pts = []
                for x in range(self.width):
                    if x % self.resolution_x == 0:
                        row_pts.append(rg.Point2d(x, y))
                self.points.append(row_pts)
    
    
    def _create_pixels(self):
        """Creates a nested list of pixel colors for an image resolution in x- and y-direction."""  
        for y in range(self.height):
            if y % self.resolution_y == 0:
                row_pxls = []
                for x in range(self.width):
                    if x % self.resolution_x == 0:
                        row_pxls.append(image.GetPixel(x, y))
                self.pixels.append(row_pxls)
    
    
    def dither(self):
        """Achieves dithering of an image using error diffusion, meaning it pushes or adds the residual 
            quantization error of a pixel onto its neighboring pixels, to be dealt with later."""
        
        
        def restrict_rgb_value(value):
            """Restricts a color value to the RGB color bounds.
        
            Args:
              value: Integer color value.
            Returns:
              The color value between 0 and 255.
            """
            if value > 255:
                return 255
            elif value < 0:
                return 0
            else:
                return value
        
        
        # Initialise the points and pixels
        self._create_points()
        self._create_pixels() # colors
        
        for y in range(len(self.pixels) - 1): # for each y from top to bottom
            for x in range(1, len(self.pixels[y]) - 1): # for each x from left to right
                pix = self.pixels[y][x]
                
                # Get the initial color values
                init_a = pix.A # alpha value
                init_r = pix.R # red value
                init_g = pix.G # green value
                init_b = pix.B # blue value
                
                # Quantize the color values to a lower number of possibilities
                quant_r = int(round(int(self.factor) * init_r / 255)) * (255 / int(self.factor))
                quant_g = int(round(int(self.factor) * init_g / 255)) * (255 / int(self.factor))
                quant_b = int(round(int(self.factor) * init_b / 255)) * (255 / int(self.factor))
                self.pixels[y][x] = Color.FromArgb(init_a, quant_r, quant_g, quant_b)
                
                # Calculate error diffusion values
                err_r = init_r - quant_r
                err_g = init_g - quant_g
                err_b = init_b - quant_b
                
                # Dithering step 1
                r = restrict_rgb_value(self.pixels[y   ][x + 1].R + err_r * 7 / 16.0)
                g = restrict_rgb_value(self.pixels[y   ][x + 1].G + err_r * 7 / 16.0)
                b = restrict_rgb_value(self.pixels[y   ][x + 1].B + err_r * 7 / 16.0)
                self.pixels[y][x + 1] = Color.FromArgb(init_a, r, g, b)
                
                # Dithering step 2
                r = restrict_rgb_value(self.pixels[y + 1][x - 1].R + err_r * 3 / 16.0)
                g = restrict_rgb_value(self.pixels[y + 1][x - 1].G + err_r * 3 / 16.0)
                b = restrict_rgb_value(self.pixels[y + 1][x - 1].B + err_r * 3 / 16.0)
                self.pixels[y + 1][x - 1] = Color.FromArgb(init_a, r, g, b)
                
                # Dithering step 3
                r = restrict_rgb_value(self.pixels[y + 1][x   ].R + err_r * 5 / 16.0)
                g = restrict_rgb_value(self.pixels[y + 1][x   ].G + err_r * 5 / 16.0)
                b = restrict_rgb_value(self.pixels[y + 1][x   ].B + err_r * 5 / 16.0)
                self.pixels[y + 1][x   ] = Color.FromArgb(init_a, r, g, b)
                
                # Dithering step 4
                r = restrict_rgb_value(self.pixels[y + 1][x + 1].R + err_r * 1 / 16.0)
                g = restrict_rgb_value(self.pixels[y + 1][x + 1].G + err_r * 1 / 16.0)
                b = restrict_rgb_value(self.pixels[y + 1][x + 1].B + err_r * 1 / 16.0)
                self.pixels[y + 1][x + 1] = Color.FromArgb(init_a, r, g, b)
     
                            
    def get_points(self):
        """Returns a flat list of 2-dimensional points."""
        return [pt for lt in self.points for pt in lt]
    
    
    def get_pixels(self):
        """Returns a flat list of pixel colors."""
        return [px for lt in self.pixels for px in lt]
    
    
    def get_boundary(self):
        """Returns the image boundary as a rectangle."""
        origin = rg.Point3d(0, 0, 0)
        dir_x = rg.Vector3d(self.width, 0, 0)
        dir_y = rg.Vector3d(0, self.height, 0)
        plane = rg.Plane(origin, dir_x, dir_y)
        return rg.Rectangle3d(plane, self.width, self.height)


######################################################################################


if __name__ == "__main__":
    # Initialise image
    
    # Initialise and run FloydSteinbergDithering
    fs = FloydSteinbergDithering(image, int(ResolutionX), int(ResolutionY), int(Factor))
    fs.dither()
    
    # Output result
    Bounds = fs.get_boundary()
    Points = fs.get_points()
    Colors = fs.get_pixels()
    
    # Display stats
    print "IMAGE STATS"
    if fs.width == fs.height: print " Type: Square"
    else: print " Type: Rectangle"
    print " Width: %d units" %(fs.width)
    print " Height: %d units" %(fs.height)
    print "\t"
    
    print "DITHERING STATS"
    print " Width: %d px" %(len(fs.pixels[0]))
    print " Height: %d px" %(len(fs.get_pixels()) / len(fs.pixels[0]))
    print " No. Pixels: %d px" %(len(fs.get_pixels()))
# ---------- end fsdither ----------
console = Panel(fsdither.out)

# ----
# Input
lng_2 = ListLength(List=fsdither.Points)
sqrt = SquareRoot(Value=lng_2)
panel_3 = Panel(sqrt)
argb = SplitARGB(Colour=col)  # -> Alpha, Red, Green, Blue
boundary = Rectangle(fsdither.Bounds)
points = Point(fsdither.Points)
colors = Colour(fsdither.Colors)
argb_2 = SplitARGB(Colour=colors)  # -> Alpha, Red, Green, Blue
python_2 = GhPythonScript(x=argb_2.Red, y=argb_2.Green, z=argb_2.Blue)  # -> out, a, b, c
# ---------- python_2: Python ----------
__author__ = "Marco"
__version__ = "2022.11.19"

import rhinoscriptsyntax as rs

def rgb_to_hsv(r, g, b):
    r = float(r)
    g = float(g)
    b = float(b)
    high = max(r, g, b)
    low = min(r, g, b)
    h, s, v = high, high, high

    d = high - low
    s = 0 if high == 0 else d/high

    if high == low:
        h = 0.0
    else:
        h = {
            r: (g - b) / d + (6 if g < b else 0),
            g: (b - r) / d + 2,
            b: (r - g) / d + 4,
        }[high]
        h /= 6

    return h, s, v

a,b,c = rgb_to_hsv(x,y,z)
# ---------- end python_2 ----------
python_3 = GhPythonScript(x=argb.Red, y=argb.Green, z=argb.Blue)  # -> out, a, b, c; same code as python_2
gl_shader = GLShader(
    Vertex=points,
    Vcolor=colors,
    DrawMode=0,
    FragmentShader="""#version 330

in vec4 vertex_color;

void main()
{
  gl_FragColor = vertex_color;
}""",
    GLShader=(0, 1, 0),
    VertexShader="""#version 330

layout(location = 0) in vec3 vertex;
layout(location = 1) in vec4 vcolor;
uniform mat4 _worldToClip;
out vec4 vertex_color;

void main() 
{
  vertex_color = vcolor;
  gl_Position = _worldToClip * vec4(vertex,1);
}""",
    glLineWidth=3,
    glPointSize=8)
preview = CustomPreview(Geometry=boundary, Shader=ColourSwatch(SwatchColor=RGB(255, 255, 255)))
pt = ConstructPoint(XCoordinate=python_2.a, YCoordinate=python_2.b, ZCoordinate=python_2.c)
pt_2 = ConstructPoint(XCoordinate=python_3.a, YCoordinate=python_3.b, ZCoordinate=python_3.c)

inblock = InsertBlock(BlockName="1 stub mesh", SourcePlane=PlaneXY(0, 0, 0))
deblock = DeconstructBlock(Block=inblock)  # -> Name, Plane, Geometry
mjoin = MeshJoin(Meshes=deblock.Geometry)
orient = Orient(Geometry=mjoin, Source=PlaneXY(0, 0, 0), Target=points)  # -> flatten(Geometry), Transform

cp = ClosestPoint(Point=pt, Cloud=pt_2)  # -> ClosestPoint, CPIndex, Distance
item = ListItem(List=col, Index=cp.CPIndex, Wrap=True)
preview_2 = CustomPreview(Geometry=orient.Geometry, Material=item)
