# Grasshopper definition legoPaint_v6.gh (Grasshopper 1.0.7)
# plug-ins: treesloth01
# {"9d1e0554-0403-4a6d-a053-d5d89c686a6f": [false, true], "603903b1-473f-4238-bb00-dff0a644fc8e": [true, false]}

imagepath = FilePath("C:\GitHub\qr-art.github.io\LegoPaint\References\1665_Girl_with_a_Pearl_Earring.jpg")
imagepath_2 = FilePath()
imagepath_3 = FilePath("C:\GitHub\qr-art.github.io\LegoPaint\References\girasoli_van gogh.jpg")
imagepath_4 = FilePath("C:\GitHub\qr-art.github.io\LegoPaint\References\dante.png")
imagepath_5 = FilePath("C:\GitHub\qr-art.github.io\LegoPaint\References\girlwithpearlearing.png")
imagepath_6 = FilePath("C:\GitHub\qr-art.github.io\LegoPaint\References\kandinsky.png")
image_resource = ImageResource(imagepath_5)
python = GhPythonScript(FilePath=image_resource)  # -> out, FilePath, image, resolution_x, resolution_y
# ---------- python: Python ----------
__author__ = "Marco"
__version__ = "2022.11.19"

import rhinoscriptsyntax as rs
from System.Drawing import Color, Bitmap
import Rhino.Geometry as rg

image = Bitmap(FilePath)

resolution_x = image.Width
resolution_y = image.Height

image.Dispose()
# ---------- end python ----------
panel = Panel(python.resolution_y)
panel_2 = Panel(python.resolution_x)
division = Division(A=panel_2, B=panel)
list = ValueList({"48", "96", "144", "192"}, selected="96")

# ----
# ALL LEGO DATABASE
path = FilePath("C:\GitHub\qr-art.github.io\LegoPaint\Database\LegoColors_Database.csv")
file = ReadFile(File=path, PerLineParse=True)
split = TextSplit(Text=file, Separators=",")
item = ListItem(List=split, Index=0, Wrap=True)  # -> flatten(Item), flatten(Item1), flatten(Item2)
panel_3 = Panel(item.Item)
python_2 = GhPythonScript(h=panel_3)  # -> out, a
# ---------- python_2: Python ----------
__author__ = "Marco"
__version__ = "2022.11.23"

import rhinoscriptsyntax as rs

a = tuple(int(h[i:i+2], 16) for i in (0, 2, 4))
# ---------- end python_2 ----------
item_2 = ListItem(List=python_2.a, Index=0, Wrap=True)  # -> Item, Item1, Item2
rgb = ColourRGB(Alpha=255, Red=item_2.Item, Green=item_2.Item1, Blue=item_2.Item2)  # -> flatten(Colour)
format = Format(Format="Code {0} - {1}", Culture=127, Data0=item.Item1, Data1=item.Item2)
legend = Legend(Colour=rgb, Tags=format, LegendType=1)

panel_4 = Panel("144")
panel_5 = Panel(division)
multiplication = Multiplication(A=list, B=panel_5)

# ----
# Available Dataset
path_2 = FilePath("C:\GitHub\qr-art.github.io\LegoPaint\Database\1x1_LegoColors.csv")
file_2 = ReadFile(File=path_2, PerLineParse=True)
panel_6 = Panel(file_2)

num = Number(list)
num_2 = Number(list)
c_script = CSharpScript(filepath=python.FilePath, x=num, y=num_2)  # -> out, ResizedImage, ResolutionX, ResolutionY, preview; inputs filepath: String, x: Int32, y: Int32
# ---------- c_script: C# usings ----------
using System.Drawing.Configuration;
using System.Drawing;
using System.Drawing.Imaging;
using System.Drawing.Drawing2D;
# ---------- c_script: C# ----------
    var image = System.Drawing.Image.FromFile(filepath);
    var oImage = ResizeImage(image, x, y);

    var filePath = @"C:\GitHub\qr-art.github.io\LegoPaint\References\Shapes100.jpg";
    oImage.Save(filePath);
    ResolutionX = oImage.Width;
    ResolutionY = oImage.Height;
    preview = filePath;
    ResizedImage = oImage;
# ---------- c_script: C# additional code ----------
  /// <summary>
  /// Resize the image to the specified width and height.
  /// </summary>
  /// <param name="image">The image to resize.</param>
  /// <param name="width">The width to resize to.</param>
  /// <param name="height">The height to resize to.</param>
  /// <returns>The resized image.</returns>
  public static Bitmap ResizeImage(Image image, int width, int height)
  {
    var destRect = new Rectangle(0, 0, width, height);
    var destImage = new Bitmap(width, height);

    destImage.SetResolution(image.HorizontalResolution, image.VerticalResolution);
    using (var graphics = Graphics.FromImage(destImage))
    {
      graphics.CompositingMode = CompositingMode.SourceCopy;
      graphics.CompositingQuality = CompositingQuality.HighQuality;
      graphics.InterpolationMode = InterpolationMode.HighQualityBicubic;
      graphics.SmoothingMode = SmoothingMode.HighQuality;
      graphics.PixelOffsetMode = PixelOffsetMode.HighQuality;

      using (var wrapMode = new ImageAttributes())
      {
        wrapMode.SetWrapMode(WrapMode.TileFlipXY);
        graphics.DrawImage(image, destRect, 0, 0, image.Width, image.Height, GraphicsUnit.Pixel, wrapMode);
      }
    }

    return destImage;
  }
# ---------- end c_script ----------
image_resource_2 = ImageResource(c_script.preview)
split_2 = TextSplit(Text=panel_6, Separators=",")
item_3 = ListItem(List=split_2, Index=0, Wrap=True)  # -> flatten(Item), flatten(Item1), flatten(Item2)

fsdither = PythonicFloydSteinbergDithering(image=c_script.ResizedImage, ResolutionX="1", ResolutionY="1", Factor="200")  # -> out, Bounds, Points, Colors; inputs ResolutionX: Int32, ResolutionY: Int32
# ---------- fsdither: Python ----------
"""Pythonic Floyd-Steinberg Image Dithering Algorithm.
    ---
    The algorithm was first published in 1976 by Robert W. Floyd and Louis Steinberg. 
    It is commonly used by image manipulation software, for example when an image is 
    converted into GIF format that is restricted to a maximum of 256 colors. 
    ---
    See also https://en.wikipedia.org/wiki/Floyd%E2%80%93Steinberg_dithering .

    Inputs:
        FilePath: Absolute file path of an image.
        ResolutionX: Resolution frequency in the image x-direction.
            ---
            A lower value equals a higher resolution and thus longer processing times.
            For instance, a frequency of 1 selects each pixel of the original image,
            whereas a frequency of 2 reproduces only every second pixel and so fourth.
            For a rectangular image ResolutionX and ResolutionY should be adjusted
            manually to get an equal pixel distribution in both directions.
            For a square image both resolution inputs should be equal.
        ResolutionY: Resolution frequency in the image y-direction.
            ---
            A lower value equals a higher resolution and thus longer processing times.
            For instance, a frequency of 1 selects each pixel of the original image,
            whereas a frequency of 2 reproduces only every second pixel and so fourth.
            For a rectangular image ResolutionY and ResolutionX should be adjusted
            manually to get an equal pixel distribution in both directions.
            For a square image both resolution inputs should be equal.
        Factor: Quantization factor restricts the maximum number of colors.
    Output:
        Bounds: Boundary of the image as rectangle.
        Points: List of pixel positions.
        Colors: List of pixel colors."""


ghenv.Component.Name = "Pythonic Floyd-Steinberg Dithering"
ghenv.Component.NickName = "FSDither"

__author__ = "p1r4t3b0y"


from System.Drawing import Color, Bitmap
import Rhino.Geometry as rg


class FloydSteinbergDithering:
    """Floyd-Steinberg image dithering algorithm.

    Attributes:
        image: An image as instance of System.Drawing.Bitmap().
        resolution_x: An integer resolution frequency in the image x-direction.
        resolution_y: An integer resolution frequency in the image y-direction.
        factor: An integer quantization factor that restricts the maximum number of colors.
    """
    
    def __init__(self, image, resolution_x, resolution_y, factor):
        """Initialises the FloydSteinbergDithering class."""
        self.image = image
        self.width = image.Width
        self.height = image.Height
        self.resolution_x = resolution_x
        self.resolution_y = resolution_y
        self.factor = factor
        self.points = []
        self.pixels = []
      
        
    def _create_points(self):
        """Creates a nested list of 2-dimensional points for an image resolution in x- and y-direction."""  
        for y in reversed(range(self.height)):
            # reversed loop to match pixel order to prevent mirrored image display
            if y % self.resolution_y == 0:
                row_pts = []
                for x in range(self.width):
                    if x % self.resolution_x == 0:
                        row_pts.append(rg.Point2d(x, y))
                self.points.append(row_pts)
    
    
    def _create_pixels(self):
        """Creates a nested list of pixel colors for an image resolution in x- and y-direction."""  
        for y in range(self.height):
            if y % self.resolution_y == 0:
                row_pxls = []
                for x in range(self.width):
                    if x % self.resolution_x == 0:
                        row_pxls.append(image.GetPixel(x, y))
                self.pixels.append(row_pxls)
    
    
    def dither(self):
        """Achieves dithering of an image using error diffusion, meaning it pushes or adds the residual 
            quantization error of a pixel onto its neighboring pixels, to be dealt with later."""
        
        
        def restrict_rgb_value(value):
            """Restricts a color value to the RGB color bounds.
        
            Args:
              value: Integer color value.
            Returns:
              The color value between 0 and 255.
            """
            if value > 255:
                return 255
            elif value < 0:
                return 0
            else:
                return value
        
        
        # Initialise the points and pixels
        self._create_points()
        self._create_pixels() # colors
        
        for y in range(len(self.pixels) - 1): # for each y from top to bottom
            for x in range(1, len(self.pixels[y]) - 1): # for each x from left to right
                pix = self.pixels[y][x]
                
                # Get the initial color values
                init_a = pix.A # alpha value
                init_r = pix.R # red value
                init_g = pix.G # green value
                init_b = pix.B # blue value
                
                # Quantize the color values to a lower number of possibilities
                quant_r = int(round(int(self.factor) * init_r / 255)) * (255 / int(self.factor))
                quant_g = int(round(int(self.factor) * init_g / 255)) * (255 / int(self.factor))
                quant_b = int(round(int(self.factor) * init_b / 255)) * (255 / int(self.factor))
                self.pixels[y][x] = Color.FromArgb(init_a, quant_r, quant_g, quant_b)
                
                # Calculate error diffusion values
                err_r = init_r - quant_r
                err_g = init_g - quant_g
                err_b = init_b - quant_b
                
                # Dithering step 1
                r = restrict_rgb_value(self.pixels[y   ][x + 1].R + err_r * 7 / 16.0)
                g = restrict_rgb_value(self.pixels[y   ][x + 1].G + err_r * 7 / 16.0)
                b = restrict_rgb_value(self.pixels[y   ][x + 1].B + err_r * 7 / 16.0)
                self.pixels[y][x + 1] = Color.FromArgb(init_a, r, g, b)
                
                # Dithering step 2
                r = restrict_rgb_value(self.pixels[y + 1][x - 1].R + err_r * 3 / 16.0)
                g = restrict_rgb_value(self.pixels[y + 1][x - 1].G + err_r * 3 / 16.0)
                b = restrict_rgb_value(self.pixels[y + 1][x - 1].B + err_r * 3 / 16.0)
                self.pixels[y + 1][x - 1] = Color.FromArgb(init_a, r, g, b)
                
                # Dithering step 3
                r = restrict_rgb_value(self.pixels[y + 1][x   ].R + err_r * 5 / 16.0)
                g = restrict_rgb_value(self.pixels[y + 1][x   ].G + err_r * 5 / 16.0)
                b = restrict_rgb_value(self.pixels[y + 1][x   ].B + err_r * 5 / 16.0)
                self.pixels[y + 1][x   ] = Color.FromArgb(init_a, r, g, b)
                
                # Dithering step 4
                r = restrict_rgb_value(self.pixels[y + 1][x + 1].R + err_r * 1 / 16.0)
                g = restrict_rgb_value(self.pixels[y + 1][x + 1].G + err_r * 1 / 16.0)
                b = restrict_rgb_value(self.pixels[y + 1][x + 1].B + err_r * 1 / 16.0)
                self.pixels[y + 1][x + 1] = Color.FromArgb(init_a, r, g, b)
     
                            
    def get_points(self):
        """Returns a flat list of 2-dimensional points."""
        return [pt for lt in self.points for pt in lt]
    
    
    def get_pixels(self):
        """Returns a flat list of pixel colors."""
        return [px for lt in self.pixels for px in lt]
    
    
    def get_boundary(self):
        """Returns the image boundary as a rectangle."""
        origin = rg.Point3d(0, 0, 0)
        dir_x = rg.Vector3d(self.width, 0, 0)
        dir_y = rg.Vector3d(0, self.height, 0)
        plane = rg.Plane(origin, dir_x, dir_y)
        return rg.Rectangle3d(plane, self.width, self.height)


######################################################################################


if __name__ == "__main__":
    # Initialise image
    
    # Initialise and run FloydSteinbergDithering
    print ResolutionX
    fs = FloydSteinbergDithering(image, int(ResolutionX), int(ResolutionY), int(Factor))
    fs.dither()
    
    # Output result
    Bounds = fs.get_boundary()
    Points = fs.get_points()
    Colors = fs.get_pixels()
    
    # Display stats
    print "IMAGE STATS"
    if fs.width == fs.height: print " Type: Square"
    else: print " Type: Rectangle"
    print " Width: %d units" %(fs.width)
    print " Height: %d units" %(fs.height)
    print "\t"
    
    print "DITHERING STATS"
    print " Width: %d px" %(len(fs.pixels[0]))
    print " Height: %d px" %(len(fs.get_pixels()) / len(fs.pixels[0]))
    print " No. Pixels: %d px" %(len(fs.get_pixels()))
# ---------- end fsdither ----------
console = Panel(fsdither.out)
panel_7 = Panel(fsdither.Bounds)

panel_8 = Panel(item_3.Item)
python_3 = GhPythonScript(hex=panel_8)  # -> rgb
# ---------- python_3: Python ----------
__author__ = "Marco"
__version__ = "2022.11.23"

import rhinoscriptsyntax as rs
import System

a = tuple(int(hex[i:i+2], 16) for i in (0, 2, 4))

rgb = System.Drawing.Color.FromArgb(a[0], a[1], a[2])
# ---------- end python_3 ----------
division_2 = Division(A=num, B="48")
division_3 = Division(A=num_2, B="48")
points = Point(fsdither.Points)
division_4 = Division(A="385", B="48")
format_2 = Format(
    Format="Code {0} - {1}, HEX {2}, {3}",
    Culture=127,
    Data0=item_3.Item1,
    Data1=item_3.Item2,
    Data2=item_3.Item,
    Data3=python_3)
scale_nu = ScaleNU(Geometry=points, Plane=PlaneXY(0, 0, 0), ScaleX=division_4, ScaleY=division_4, ScaleZ=1)  # -> Geometry, Transform
legend_2 = Legend(Colour=python_3, Tags=format_2, LegendType=1)
points_2 = Point(scale_nu.Geometry)
colors = Colour(fsdither.Colors)
python_4 = GhPythonScript(points=points_2)  # -> rtree; inputs points: list of Point3d
# ---------- python_4: Python ----------
__author__ = "Marco"
__version__ = "2022.11.26"

import rhinoscriptsyntax as rs
import Rhino.Geometry as rg


rtree = rg.RTree.CreateFromPointArray(points)
# ---------- end python_4 ----------

# ----
# Lego Piece
mesh = Mesh(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)
mesh_2 = Mesh(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)
mjoin = MeshJoin(Meshes=mesh)
mjoin_2 = MeshJoin(Meshes=mesh_2)

scale_nu_2 = ScaleNU(Geometry=mjoin, Plane=PlaneXY(0, 0, 0), ScaleX="0.975", ScaleY="0.975", ScaleZ=1)  # -> Geometry, Transform

orient = Orient(Geometry=scale_nu_2.Geometry, Source=PlaneXY(0, 0, 0), Target=scale_nu.Geometry)  # -> flatten(Geometry), Transform

orient_2 = Orient(Geometry=mjoin, Source=PlaneXY(0, 0, 0), Target=scale_nu.Geometry)  # -> flatten(Geometry), Transform
bbox = BoundingBox(Content=orient_2.Geometry, Plane=PlaneXY(0, 0, 0), UnionBox=True)  # -> Box, Box_2
debrep = DeconstructBrep(Brep=bbox.Box)  # -> Faces, Edges, Vertices
area = Area(Geometry=debrep.Faces)  # -> Area, Centroid
pdecon = Deconstruct(Point=area.Centroid)  # -> XComponent, YComponent, ZComponent
sort = SortList(Keys=pdecon.ZComponent, ValuesA=debrep.Faces)  # -> Keys, ValuesA
item_4 = ListItem(List=sort.ValuesA, Index=0, Wrap=True)
srf = Surface(item_4)
divide = DivideDomain²(Domain=srf, UCount=division_2, VCount=division_3)
subsrf = Isotrim(Surface=srf, Domain=divide)
mplane = MeshPlane(Boundary=subsrf, WidthCount="48", HeightCount="48")  # -> Mesh, Area
facen = FaceNormals(Mesh=mplane.Mesh)  # -> Centers, Normals
python_5 = GhPythonScript(rtree=python_4, y=facen.Centers)  # -> out, simplify(indexes); inputs y: Point3d
# ---------- python_5: Python ----------
__author__ = "Marco"
__version__ = "2022.11.26"

import rhinoscriptsyntax as rs
import Rhino.Geometry as rg

indexes = []
def SearchCallback(sender, e):

    e.SearchSphere = rg.Sphere(y, 0.01)
    indexes.append( e.Id )

sphere = rg.Sphere( y, 0.01 )

rtree.Search(sphere, SearchCallback)
# ---------- end python_5 ----------
shift = ShiftPaths(Data=python_5.indexes, Offset=-1)
item_5 = ListItem(List=colors, Index=shift, Wrap=True)
python_6 = GhPythonScript(x=item_5)  # -> out, a; inputs x: Color
# ---------- python_6: Python ----------
__author__ = "Marco"
__version__ = "2022.12.01"

import rhinoscriptsyntax as rs
import System.Drawing.Color

if x == System.Drawing.Color.FromArgb(0,0,0,0):
    a = System.Drawing.Color.White
else:
    a = x
# ---------- end python_6 ----------
item_6 = ListItem(List=points_2, Index=shift, Wrap=True)
item_7 = ListItem(List=orient.Geometry, Index=shift, Wrap=True)

# ----
# Get Closest Colors
list_2 = ValueList({"rgb": 0, "hsv": 1}, selected="rgb")
colors_2 = Colour(python_6.a)
col = Colour(python_3)
argb = SplitARGB(Colour=colors_2)  # -> Alpha, Red, Green, Blue
argb_2 = SplitARGB(Colour=col)  # -> Alpha, Red, Green, Blue
python_7 = GhPythonScript(x=argb_2.Red, y=argb_2.Green, z=argb_2.Blue)  # -> out, a, b, c
# ---------- python_7: Python ----------
__author__ = "Marco"
__version__ = "2022.11.19"

import rhinoscriptsyntax as rs

def rgb_to_hsv(r, g, b):
    r = float(r)
    g = float(g)
    b = float(b)
    high = max(r, g, b)
    low = min(r, g, b)
    h, s, v = high, high, high

    d = high - low
    s = 0 if high == 0 else d/high

    if high == low:
        h = 0.0
    else:
        h = {
            r: (g - b) / d + (6 if g < b else 0),
            g: (b - r) / d + 2,
            b: (r - g) / d + 4,
        }[high]
        h /= 6

    return h, s, v

a,b,c = rgb_to_hsv(x,y,z)
# ---------- end python_7 ----------
python_8 = GhPythonScript(x=argb.Red, y=argb.Green, z=argb.Blue)  # -> out, a, b, c; same code as python_7
pt = ConstructPoint(XCoordinate=argb_2.Red, YCoordinate=argb_2.Green, ZCoordinate=argb_2.Blue)
pt_2 = ConstructPoint(XCoordinate=python_7.a, YCoordinate=python_7.b, ZCoordinate=python_7.c)
pt_3 = ConstructPoint(XCoordinate=argb.Red, YCoordinate=argb.Green, ZCoordinate=argb.Blue)
pt_4 = ConstructPoint(XCoordinate=python_8.a, YCoordinate=python_8.b, ZCoordinate=python_8.c)
filter = StreamFilter(Gate=list_2, Stream0=pt_3, Stream1=pt_4)
filter_2 = StreamFilter(Gate=list_2, Stream0=pt, Stream1=pt_2)
cp = ClosestPoint(Point=filter, Cloud=filter_2)  # -> ClosestPoint, CPIndex, Distance
item_8 = ListItem(List=col, Index=cp.CPIndex, Wrap=True)
col_2 = Colour(item_8)

python_9 = GhPythonScript(x=col_2)  # -> out, a; inputs x: Color
# ---------- python_9: Python ----------
__author__ = "Marco"
__version__ = "2022.12.01"

import rhinoscriptsyntax as rs
import System.Drawing.Color

if x == System.Drawing.Color.FromArgb(0,0,0):
    a = System.Drawing.Color.White
else:
    a = x
# ---------- end python_9 ----------
panel_9 = Panel(col_2)
graft = GraftTree(Tree=item_7, IncludeEmptyLists=True, IncludeNullItems=True)
graft_2 = GraftTree(Tree=col_2, IncludeEmptyLists=True, IncludeNullItems=True)

python_10 = GhPythonScript(rgb=col_2)  # -> hex
# ---------- python_10: Python ----------
__author__ = "Marco"
__version__ = "2022.11.23"

import rhinoscriptsyntax as rs

def rgb_to_hex(r, g, b):
  return ('{:X2}{:X2}{:X2}').format(r, g, b)

hex = rgb_to_hex(rgb.R, rgb.G, rgb.B)
# ---------- end python_10 ----------
item_9 = ListItem(List=split_2, Index=0, Wrap=True)  # -> flatten(Item), flatten(Item1), flatten(Item2)
txt = Text(flatten(python_10))
txt_2 = Text(item_9.Item)
mindex = MemberIndex(Set=txt, Member=txt_2)  # -> simplify(Index), Count
python_11 = GhPythonScript(hex=item_9.Item)  # -> rgb; same code as python_3
clean = CleanTree(RemoveNulls=True, RemoveInvalid=True, RemoveEmpty=invert(False), Tree=simplify(mindex.Index))
graft_3 = GraftTree(Tree=python_11, IncludeEmptyLists=True, IncludeNullItems=True)
graft_4 = GraftTree(Tree=item_9.Item1, IncludeEmptyLists=True, IncludeNullItems=True)
graft_5 = GraftTree(Tree=item_9.Item2, IncludeEmptyLists=True, IncludeNullItems=True)
lng = ListLength(List=mindex.Index)
tstat = TreeStatistics(Tree=clean)  # -> Paths, Length, Count
branch = TreeBranch(Tree=simplify(graft_3), Path=tstat.Paths, MaintainPaths=True)  # -> flatten(Branch)
branch_2 = TreeBranch(Tree=simplify(graft_4), Path=tstat.Paths, MaintainPaths=True)  # -> flatten(Branch)
branch_3 = TreeBranch(Tree=simplify(graft_5), Path=tstat.Paths, MaintainPaths=True)  # -> flatten(Branch)
branch_4 = TreeBranch(Tree=simplify(lng), Path=tstat.Paths, MaintainPaths=True)  # -> flatten(Branch)
sort_2 = SortList(Keys=branch_4, ValuesA=branch_3, ValuesB=branch_2, ValuesC=branch)  # -> reverse(Keys), reverse(ValuesA), reverse(ValuesB), reverse(ValuesC)
format_3 = Format(Format="{0}-{1}-{2}", Culture=127, Data0=sort_2.ValuesB, Data1=sort_2.ValuesA, Data2=sort_2.Keys)
format_4 = Format(Format="Code {0}-{1}-n° pieces: {2}", Culture=127, Data0=sort_2.ValuesB, Data1=sort_2.ValuesA, Data2=sort_2.Keys)
legend_3 = Legend(Colour=sort_2.ValuesC, Tags=format_4, LegendType=1)
merge = Merge(Data1="Code, Color, Pieces", Data2=format_3)

# ----
# Visualisation
int = Integer(mindex.Index)
col_3 = Colour(graft_3)
item_10 = ListItem(List=orient.Geometry, Index=int, Wrap=True)
mjoin_3 = MeshJoin(Meshes=item_10)
mcol = MeshColours(Mesh=mjoin_3, Colours=col_3)
mesh_3 = Mesh(mcol)
preview = CustomPreview(
    Geometry=mesh_3,
    Material={diffuse=RGB(221, 160, 221), emission=RGB(66, 48, 66), shine=0.5, specular=RGB(255, 255, 255), transparency=0})

ma = MassAddition(Input=sort_2.Keys)  # -> Result, PartialResults

# ----
# Export
toggle = BooleanToggle(True)
txt_3 = Text(merge)
python_12 = GhPythonScript(text=txt_3, name="ORDER.csv", save=toggle)  # -> out, a; inputs text: list, save: Boolean
# ---------- python_12: Python ----------
__author__ = "Marco"
__version__ = "2022.11.26"

import rhinoscriptsyntax as rs
import os
import io

os.chdir( rs.DocumentPath() )

newText = []
for line in text:
    newText.append( line.replace("-", ",") )


with io.open(name, "w", encoding='utf-8') as f:
    f.writelines('\n'.join(newText))
# ---------- end python_12 ----------

# ----
# Visualisation
mcol_2 = MeshColours(Mesh=graft, Colours=graft_2)

shift_2 = ShiftPaths(Data=simplify(mcol_2), Offset=-1)
mjoin_4 = MeshJoin(Meshes=shift_2)  # -> flatten(Mesh)
branch_5 = TreeBranch(Tree=shift_2, Path=Slider(3, range=0..8), MaintainPaths=True)

mesh_4 = Mesh(mjoin_4)
preview_2 = CustomPreview(
    Geometry=mesh_4,
    Material={diffuse=RGB(221, 160, 221), emission=RGB(66, 48, 66), shine=0.5, specular=RGB(255, 255, 255), transparency=0})

demesh = DeconstructMesh(Mesh=branch_5)  # -> Vertices, Faces, Colours, Normals
item_11 = ListItem(List=demesh.Colours, Index=0, Wrap=True)
python_13 = GhPythonScript(rgb=item_11)  # -> flatten(hex); same code as python_10
partition = PartitionList(List=python_13, Size="48")  # -> simplify(Chunks)
panel_10 = Panel(partition)
txt_4 = Text(panel_10)
join = TextJoin(Text=txt_4, Join=",")  # -> flatten(Result)

# ----
# Export
toggle_2 = BooleanToggle(True)
txt_5 = Text(join)
python_14 = GhPythonScript(text=txt_5, name="Instructions\instruction.csv", save=toggle_2)  # -> out, file_path; inputs text: list, save: Boolean
# ---------- python_14: Python ----------
__author__ = "Marco"
__version__ = "2022.11.26"

import rhinoscriptsyntax as rs
import os
import io

os.chdir( rs.DocumentPath() )

if save:
    with io.open(name, "w", encoding='utf-8') as f:
        f.writelines('\n'.join(text))

file_path = name
# ---------- end python_14 ----------

python_15 = GhPythonScript(speed="1", file_path=python_14.file_path, run=Toggle(False))  # -> out, a; inputs run: Boolean
# ---------- python_15: Python ----------
__author__ = "Marco"
__version__ = "2022.11.29"

import rhinoscriptsyntax as rs
import subprocess

if run:
    subprocess.call(['python', 'Instructions\test.py', file_path, speed])
# ---------- end python_15 ----------
