# Grasshopper definition DeserialiseToXML.gh (Grasshopper 1.0.7)

path = FilePath("/Users/mp/Documents/GitHub/qr-art.github.io/LegoPaint/Database/1x1_LegoColors.csv")
file = ReadFile(File=path, PerLineParse=True)
panel = Panel(file)

split_list = SplitList(List=panel, Index="1")  # -> ListA, ListB
split = TextSplit(Text=split_list.ListB, Separators=",")
item = ListItem(List=split, Index=0, Wrap=True)  # -> flatten(Item), flatten(Item1), flatten(Item2), flatten(Item3)
panel_2 = Panel(item.Item)
python = GhPythonScript(hex=panel_2)  # -> rgb
# ---------- python: Python ----------
__author__ = "Marco"
__version__ = "2022.11.23"

import rhinoscriptsyntax as rs
import System

a = tuple(int(hex[i:i+2], 16) for i in (0, 2, 4))

rgb = System.Drawing.Color.FromArgb(a[0], a[1], a[2])
# ---------- end python ----------
lng = ListLength(List=python)
series = Series(Start=0, Step=1, Count=lng)
format = Format(
    Format="{4}, Code {0} - {1}, Id {5}, HEX {2}, {3}",
    Culture=127,
    Data0=item.Item1,
    Data1=item.Item2,
    Data2=item.Item,
    Data3=python,
    Data4=series,
    Data5=item.Item3)
list = ValueList({"Plate 1 x 1": 3024}, selected="Plate 1 x 1")
legend = Legend(Colour=python, Tags=format, LegendType=1)
c_script = CSharpScript(ITEMID=list)  # -> out, INVENTORY; inputs ITEMID: Int32, COLOR: list of Int32, QUANTITY: list of Int32
# ---------- c_script: C# usings ----------
using System.Xml.Serialization;
using System.Xml;
using System.Reflection;
using System.IO;
# ---------- c_script: C# ----------
    var legoItems = new List<LegoItem>();

    for (int i = 0; i < COLOR.Count; i++)
    {
      var piece = new LegoItem("P", ITEMID, COLOR[i], QUANTITY[i]);
      legoItems.Add(piece);
    }



    var _inventory = new Inventory(legoItems).SerializeToString();

    INVENTORY = _inventory;
# ---------- c_script: C# additional code ----------
  public class LegoItem
  {
    [XmlElement("ITEMTYPE")]
    public string ItemType = "P";

    [XmlElement("MINQTY")]
    public int NumberOfItem;

    [XmlElement("COLOR")]
    public int Color;

    [XmlElement("ITEMID")]
    public int Id;


    public LegoItem()
    {
    }


    public LegoItem(string itemType, int id, int color, int numberOfItem)
    {
      this.ItemType = itemType;
      this.NumberOfItem = numberOfItem;
      this.Color = color;
      this.Id = id;
    }


    public string SerializeToString()
    {
      // serialize
      XmlSerializer serializer = new XmlSerializer(typeof(LegoItem));
      using (TextWriter writer = new StringWriter())
      {
        serializer.Serialize(writer, this);
        return writer.ToString();
      }
    }
  }


  [System.Serializable]
  [XmlRoot("INVENTORY")]
  public class Inventory
  {
    [XmlElement("ITEM")]
    public List<LegoItem> LegoItems;

    public Inventory()
    {
    }

    public Inventory(List<LegoItem> legoItems)
    {
      this.LegoItems = legoItems;
    }


    public string SerializeToString()
    {

      var xns = new XmlSerializerNamespaces();
      xns.Add(string.Empty, string.Empty);

      // serialize
      XmlSerializer serializer = new XmlSerializer(typeof(Inventory));
      using (TextWriter writer = new StringWriter())
      {
        serializer.Serialize(writer, this, xns);
        return writer.ToString();
      }
    }


  }
# ---------- end c_script ----------
panel_3 = Panel(c_script.INVENTORY)
