# Grasshopper definition legoPaint_v4_no cluster.gh (Grasshopper 1.0.7)
# plug-ins: MeshEdit Components, EleFront, treesloth01

number_of_plates___z = Panel("2")
number_of_plates___x = Panel("2")
mm = Panel("385")
# ALGORITHM: - Reduce image to number of pixel equal to LEGO PLATE
# - Reduce number of color with online algorithm
sqgrid = Square(Plane=PlaneXY(0, 0, 0), Size=mm, ExtentX=number_of_plates___x, ExtentY=number_of_plates___z)  # -> Cells, Points
panel = Panel("96")
crv = Curve(sqgrid.Cells)
mplane = MeshPlane(Boundary=crv, WidthCount="48", HeightCount="48")  # -> Mesh, Area
mesh_join = MeshJoin(Meshes=flatten(mplane.Mesh))
face_normals = FaceNormals(Mesh=mplane.Mesh)  # -> flatten(Centers), Normals
pt = Point(face_normals.Centers)
pdecon = Deconstruct(Point=pt)  # -> XComponent, YComponent, ZComponent
mesh_explode = MeshExplode(Mesh=mesh_join, Interpolate=False)
bnd = Bounds(Numbers=pdecon.XComponent)
bnd_2 = Bounds(Numbers=pdecon.YComponent)
remap = RemapNumbers(Value=pdecon.XComponent, Source=bnd, Target=Domain(0, 1))  # -> Mapped, Clipped
remap_2 = RemapNumbers(Value=pdecon.YComponent, Source=bnd_2, Target=Domain(0, 1))  # -> Mapped, Clipped
vec = VectorXYZ(XComponent=remap.Mapped, YComponent=remap_2.Mapped, ZComponent=0)  # -> Vector, Length
image = ImageSampler(
    vec.Vector,
    FilePath="C:\Users\Marco\Downloads\imgonline-com-ua-limitcolYxxQhYHa2bIR.jpg",
    Filter="Colour",
    Interpolate=False,
    Umax=1,
    Umin=0,
    Vmax=1,
    Vmin=0,
    Wrap=1)
ghpython_script = GhPythonScript()  # -> out, r, g, b
# ---------- ghpython_script: Python ----------
colors =    {1:"124,92,66",
             2: "126,156,134",
             3: "102,43,50",
             4:  "80,44,25",
             5: "147,148,147",
             6: "101,101,101",
             7: "209,130,60",
             8: "83,161,90",
             9: "174,37,26",
             10: "130,95,154",
             11: "42,60,99",
             12: "237,199,67",
             13: "53,96,171",
             14: "176,163,118",
             15: "76,76,76",
             16: "215,215,215",
             17: "133,79,53",
             18: "164,182,215",
             19: "233,184,154",
             20: "58,81,61",
             21: "72,126,167",
             22: "159,188,83",
             23: "87,68,141",
             24: "198,68,156",
             25: "65,137,133",
             26: "61,47,21",
             27: "108,156,180",
             28: "132,64,120",
             29: "185,205,200",
             30: "248,226,129",
             31: "103,108,55",
             32: "228,154,197",
             33: "228,162,68",
             34: "5,5,5"}

keys = colors.keys()

r = []
g = []
b = []

for i in keys:
    a = colors[i]

    items = a.split(",")

    r.append( items[0] )
    g.append( items[1] )
    b.append( items[2] )
# ---------- end ghpython_script ----------
colour_rgb = ColourRGB(Alpha=255, Red=ghpython_script.r, Green=ghpython_script.g, Blue=ghpython_script.b)
col = Colour(colour_rgb)
argb = SplitARGB(Colour=col)  # -> Alpha, Red, Green, Blue
argb_2 = SplitARGB(Colour=image)  # -> Alpha, Red, Green, Blue
argb_3 = SplitARGB(Colour=image)  # -> Alpha, Red, Green, Blue
entwine = Entwine(Branch00=argb.Red, Branch01=argb.Green, Branch02=argb.Blue, FlattenInputs=True)
python = GhPythonScript(x=argb_2.Red, y=argb_2.Green, z=argb_2.Blue)  # -> out, a, b, c
# ---------- python: Python ----------
__author__ = "Marco"
__version__ = "2022.11.19"

import rhinoscriptsyntax as rs

if(x == 0 and y == 0 and z == 0):
    a = 1
    b = 1
    c = 1
else:
    a = x
    b = y
    c = z
# ---------- end python ----------
flip = FlipMatrix(Data=entwine)  # -> simplify(Data)
entwine_2 = Entwine(Branch00=python.a, Branch01=python.b, Branch02=python.c, FlattenInputs=True)
pt_2 = ConstructPoint(XCoordinate=argb_3.Red, YCoordinate=argb_3.Green, ZCoordinate=argb_3.Blue)
item = ListItem(List=flip, Index=0, Wrap=True)  # -> Item, Item1, Item2
frgb = ColourRGBF(Alpha=1, Red=item.Item, Green=item.Item1, Blue=item.Item2)  # -> flatten(Colour)
lng = ListLength(List=frgb)

inblock = InsertBlock(BlockName="1 stub mesh", SourcePlane=PlaneXY(0, 0, 0))
demesh = DeconstructMesh(Mesh=mesh_explode)  # -> Vertices, Faces, Colours, Normals
deblock = DeconstructBlock(Block=inblock)  # -> Name, Plane, Geometry
item_2 = ListItem(List=demesh.Vertices, Index=0, Wrap=True)
mjoin = MeshJoin(Meshes=deblock.Geometry)
xy = XYPlane(Origin=item_2)
orient = Orient(Geometry=mjoin, Source=PlaneXY(0, 0, 0), Target=xy)  # -> flatten(Geometry), Transform

series = Series(Start=0, Step=1, Count=lng)
concat = Concatenate(FragmentA=series, FragmentB=frgb, JoinSeparator=" -")
legend = Legend(Colour=frgb, Tags=concat, LegendType=1)
pt_3 = Point(pt_2)
num2pt = NumbersToPoints(Numbers=flip, Mask=4)  # -> flatten(Points)
cp = ClosestPoint(Point=pt_3, Cloud=num2pt)  # -> ClosestPoint, CPIndex, Distance
item_3 = ListItem(List=col, Index=cp.CPIndex, Wrap=True)
data = Data(flatten(item_3))
cset = CreateSet(List=data)  # -> Set, Map
graft = GraftTree(Tree=item_3, IncludeEmptyLists=True, IncludeNullItems=True)
graft_2 = GraftTree(Tree=orient.Geometry, IncludeEmptyLists=True, IncludeNullItems=True)
list = ValueList({"preview": 0, "lego brick": 1}, selected="lego brick")
mesh_colours = MeshColours(Mesh=graft_2, Colours=graft)
filter = StreamFilter(Gate=list)
shift = ShiftPaths(Data=simplify(mesh_colours), Offset=-1)
mesh_join_2 = MeshJoin(Meshes=shift)
mesh = Mesh(flatten(mplane.Mesh))
tstat = TreeStatistics(Tree=mesh_join_2)  # -> Paths, Length, Count
mjoin_2 = MeshJoin(Meshes=flatten(mesh))
multiplication = Multiplication(A=mm, B=number_of_plates___x, C="2")
sqrt = SquareRoot(Value=tstat.Count)
round = Round(Number=sqrt)  # -> Nearest, Floor, Ceiling
sqgrid_2 = Square(Plane=PlaneXY(0, 0, 0), Size=multiplication, ExtentX=round.Ceiling, ExtentY=round.Ceiling)  # -> flatten(Cells), Points
split = SplitList(List=sqgrid_2.Cells, Index=tstat.Count)  # -> ListA, ListB
area = Area(Geometry=split.ListA)  # -> Area, Centroid
area_2 = MeshArea(Mesh=mjoin_2)  # -> Area, flatten(Centroid)
subtraction = Subtraction(A=area.Centroid, B=area_2.Centroid)
move = Move(Geometry=flatten(mesh_join_2), Motion=subtraction)  # -> Geometry, Transform

# ----
# Calculate the Cost
geo = Geometry(mesh)  # disabled
meshcolored = Data(filter)  # disabled
param_viewer = ParamViewer(meshcolored)  # disabled
number_slider = Slider(14, range=0..20)  # disabled
jitter = Jitter(List=param_viewer, Jitter=1, Seed=number_slider)  # -> Values, Indices; disabled
tree_branch = TreeBranch(Tree=meshcolored, Path=jitter.Values, MaintainPaths=False)  # disabled
cluster = Data(tree_branch)  # disabled
panel_2 = Panel("0.06")  # disabled
panel_3 = Panel("8.99")  # disabled
ghpython_script_2 = GhPythonScript(Cluster=cluster, iMeshPlate=geo, platePrice=panel_3, brickPrice=panel_2)  # -> out, totalCost; inputs Cluster: tree of Mesh, iMeshPlate: list of Mesh; disabled
# ---------- ghpython_script_2: Python ----------
__author__ = "mpmac"

import rhinoscriptsyntax as rs


number_of_tree = Cluster.BranchCount
for i in range(number_of_tree):
    value = Cluster.Branch(i).Count
    print "Cluster {0}: {1:4} pcs".format(i+1,value)

number_of_brick = Cluster.DataCount

brickCost = number_of_brick * brickPrice

number_of_plate = len(iMeshPlate)
plateCost = number_of_plate * platePrice

totalCost = brickCost + plateCost

print "Number of Brick: {0:4}".format(number_of_brick)
print "Number of Plate: {0:4}".format(number_of_plate)
print "Bricks Cost: {0:6} €".format(brickCost)
print "Plates Cost: {0:6} €".format(plateCost)
print "--------------------"
print "Total Cost:  {0:6} €".format(totalCost)
# ---------- end ghpython_script_2 ----------
panel_4 = Panel(ghpython_script_2.totalCost)  # disabled
panel_5 = Panel(ghpython_script_2.out)  # disabled

preview = CustomPreview(
    Geometry=move.Geometry,
    Material={diffuse=RGB(221, 160, 221), emission=RGB(66, 48, 66), shine=0.5, specular=RGB(255, 255, 255), transparency=0})
