# Grasshopper definition venus-milo(1).gh (Grasshopper 1.0.7)
# plug-ins: Pufferfish, Weaverbird, Wombat

xz = XZPlane(Origin=Point(0, 0, 0))
Y = UnitY(Factor=Slider(20, range=0..100))
mesh = Mesh(<mesh referenced from the Rhino model>)
move = Move(Geometry=xz, Motion=Y)  # -> Geometry, Transform
plntrimmsh = PlaneTrimMesh(Mesh=mesh, Plane=move.Geometry, Flip=Toggle(False), TrimType=0)  # -> Trimmed, Intersected
mesh_2 = Mesh(plntrimmsh.Trimmed)
bbox = BoundingBox(Content=mesh_2, Plane=PlaneXY(0, 0, 0))  # -> Box, Box_2
debrep = DeconstructBrep(Brep=bbox.Box)  # -> Faces, Edges, Vertices
wbnaked = WeaverbirdsNakedBoundary(MeshClosedPolylines=mesh_2)
boundarym = BoundaryMesh(Polyline=wbnaked)
item = ListItem(List=debrep.Faces, Index=Slider(2, range=0..5), Wrap=True)
edges = BrepEdges(Brep=item)  # -> Naked, Interior, NonManifold
mjoin = MeshJoin(Meshes=flatten([boundarym, mesh_2]))
crv = Curve(edges.Naked)
preview = CustomPreview(Geometry=mjoin, Material=ColourSwatch(SwatchColor=RGB(255, 255, 255)))
join = JoinCurves(Curves=crv, Preserve=False)
offset = OffsetCurve(Curve=join, Distance="2", Corners=1)
boundary = BoundarySurfaces(Edges=offset)
neg = Negative(Value="1")
offsrf = OffsetSurface(Surface=boundary, Distance=neg, BothSides=0, CreateSolid=True)
mjoin_2 = MeshJoin(Meshes=flatten([offsrf, mjoin]))
X = UnitX(Factor=1)
contour = ContourEx(Plane=PlaneXY(0, 0, 0))
contour_2 = Contour(Shape=mjoin_2, Point=Point(0, 0, 0), Direction=X, Distance="1")
