# Grasshopper definition venus-milo_2.gh (Grasshopper 1.0.7)
# plug-ins: Pufferfish, Weaverbird, Wombat, RhinoCodePluginGH

mesh = Mesh(<mesh referenced from the Rhino model>)
bbox = BoundingBox(Content=mesh, Plane=PlaneXY(0, 0, 0))  # -> Box, Box_2
debox = DeconstructBox(Box=bbox.Box)  # -> Plane, X, Y, Z
target_height = Panel("65")
thickness = Panel("0.3")
S = Script(x=debox.Z)  # -> a
# ---------- S: Python ----------
"""Grasshopper Script"""
a = "Hello IronPython 2 in Grasshopper!"
print(a)

a = x.Length
# ---------- end S ----------
division = Division(A=target_height, B=S)
scale = Scale(Geometry=mesh, Center=Point(0, 0, 0), Factor=division)  # -> Geometry, Transform
bbox_2 = BoundingBox(Content=scale.Geometry, Plane=PlaneXY(0, 0, 0))  # -> Box, Box_2
debrep = DeconstructBrep(Brep=bbox_2.Box)  # -> Faces, Edges, Vertices
item = ListItem(List=debrep.Faces, Index=0, Wrap=True)  # -> Item, Item1, Item2, Item3, Item4, Item5
pln = Plane(item.Item4)
pln_2 = Plane(item.Item)
unit_y = UnitY(Factor=Slider(10, range=0..10))
rotate = Rotate(Geometry=scale.Geometry, Angle=degrees(Slider(0, range=-30..30)), Plane=pln)  # -> Geometry, Transform
move = Move(Geometry=pln_2, Motion=unit_y)  # -> Geometry, Transform
plane_trim_mesh = PlaneTrimMesh(Mesh=rotate.Geometry, Plane=move.Geometry, Flip=Toggle(False), TrimType=0)  # -> Trimmed, Intersected
mesh_2 = Mesh(plane_trim_mesh.Trimmed)
bounding_box = BoundingBox(Content=mesh_2, Plane=PlaneXY(0, 0, 0))  # -> Box, Box_2
deconstruct_brep = DeconstructBrep(Brep=bounding_box.Box)  # -> Faces, Edges, Vertices
list_item = ListItem(List=deconstruct_brep.Faces, Index=Slider(2, range=0..5), Wrap=True)
brep_edges = BrepEdges(Brep=list_item)  # -> Naked, Interior, NonManifold
weaverbird_s_naked_boundary = WeaverbirdsNakedBoundary(MeshClosedPolylines=mesh_2)
curve = Curve(brep_edges.Naked)
boundary_mesh = BoundaryMesh(Polyline=weaverbird_s_naked_boundary)
join_curves = JoinCurves(Curves=curve, Preserve=False)
explode = Explode(Curve=join_curves, Recursive=True)  # -> Segments, Vertices
len = Length(Curve=explode.Segments)
division_2 = Division(A="65", B=1.33)
target_width = Panel("45")
area = Area(Geometry=join_curves)  # -> Area, Centroid
number_slider = Slider(1.431, range=1..1.5)
sort = SortList(Keys=len)  # -> Keys, ValuesA
xz = XZPlane(Origin=area.Centroid)
item_2 = ListItem(List=sort.Keys, Index=0, Wrap=True)
division_3 = Division(A=target_width, B=item_2)
scale_nu = ScaleNU(Geometry=join_curves, Plane=xz, ScaleX=division_3, ScaleY=Slider(1.072, range=1..1.5), ScaleZ=1)  # -> Geometry, Transform
boundary_surfaces = BoundarySurfaces(Edges=scale_nu.Geometry)
srfsplit = SurfaceSplit(Surface=boundary_surfaces, Curves=weaverbird_s_naked_boundary)
item_3 = ListItem(List=srfsplit, Index=0, Wrap=True)
edges = BrepEdges(Brep=item_3)  # -> Naked, Interior, NonManifold
num = Number(thickness)
crv = Curve(edges.Naked)
debrep_2 = DeconstructBrep(Brep=boundary_surfaces)  # -> Faces, Edges, Vertices
mesh_join = MeshJoin(Meshes=flatten(mesh_2))
facen = FaceNormals(Mesh=debrep_2.Faces)  # -> Centers, Normals
crv_2 = Curve(debrep_2.Edges)
rev = Reverse(Vector=facen.Normals)
multiplication = Multiplication(A=rev, B="0.50")
move_2 = Move(Geometry=crv_2, Motion=multiplication)  # -> Geometry, Transform
extr = Extrude(Base=crv_2, Direction=multiplication)
boundary = BoundarySurfaces(Edges=move_2.Geometry)
merge = Merge(Data1=boundary, Data2=extr, Data3=item_3, Data4=mesh_join)  # -> flatten(Result)
mesh_3 = Mesh(merge)
explode_2 = Explode(Curve=scale_nu.Geometry, Recursive=True)  # -> Segments, Vertices
item_4 = ListItem(List=explode_2.Segments, Index=0, Wrap=True)  # -> Item, Item1
mjoin = MeshJoin(Meshes=mesh_3)
len_2 = Length(Curve=item_4.Item1)
division_4 = Division(A=len_2, B=num)
round = Round(Number=division_4)  # -> Nearest, Floor, Ceiling
cullpt = CullDuplicates(Points=explode_2.Vertices, Tolerance=0.1, CullMode=3)  # -> Points, Indices, Valence
yz_plane = YZPlane(Origin=Point(0, 0, 0))
series = Series(Start=0, Step=num, Count=round.Ceiling)
item_5 = ListItem(List=cullpt.Points, Index=0, Wrap=True)
X = UnitX(Factor=series)
move_3 = Move(Geometry=item_5, Motion=X)  # -> Geometry, Transform
plane_origin = PlaneOrigin(Base=yz_plane, Origin=move_3.Geometry)
mesh_plane = MeshPlane(Mesh=mjoin, Plane=plane_origin)
clean = CleanTree(RemoveNulls=True, RemoveInvalid=True, RemoveEmpty=invert(False), Tree=mesh_plane)  # -> simplify(Tree)
division_5 = Division(A=num, B=2)
boundary_surfaces_2 = BoundarySurfaces(Edges=clean)
jagged = SettingsSpeed()
negative = Negative(Value=division_5)
mesh_4 = MeshBrep(Brep=boundary_surfaces_2, Settings=jagged)
offmsh = OffsetMesh(Mesh=mesh_4, Distance=division_5, BothSides=negative, CreateSolid=True)
mjoin_2 = MeshJoin(Meshes=flatten(offmsh))
create_material = CreateMaterial(
    Diffuse=ColourSwatch(SwatchColor=RGB(255, 161, 161)),
    Specular=RGB(255, 254, 254),
    Emission=RGB(0, 0, 0),
    Transparency=0,
    Shine=0)
custom_preview = CustomPreview(Geometry=clean, Material=ColourSwatch(SwatchColor=RGB(0, 0, 0)))
custom_preview_2 = CustomPreview(Geometry=offmsh, Material=create_material)
