# Grasshopper definition venus-milo.gh (Grasshopper 1.0.7)
# plug-ins: Pufferfish, Weaverbird, Wombat

xz_plane = XZPlane(Origin=Point(0, 0, 0))
unit_y = UnitY(Factor=Slider(20, range=0..100))
move = Move(Geometry=xz_plane, Motion=unit_y)  # -> Geometry, Transform
mesh = Mesh(<mesh referenced from the Rhino model>)
plane_trim_mesh = PlaneTrimMesh(Mesh=mesh, Plane=move.Geometry, Flip=Toggle(False), TrimType=0)  # -> Trimmed, Intersected
mesh_2 = Mesh(plane_trim_mesh.Trimmed)
bounding_box = BoundingBox(Content=mesh_2, Plane=PlaneXY(0, 0, 0))  # -> Box, Box_2
weaverbird_s_naked_boundary = WeaverbirdsNakedBoundary(MeshClosedPolylines=mesh_2)
deconstruct_brep = DeconstructBrep(Brep=bounding_box.Box)  # -> Faces, Edges, Vertices
boundary_mesh = BoundaryMesh(Polyline=weaverbird_s_naked_boundary)
list_item = ListItem(List=deconstruct_brep.Faces, Index=Slider(2, range=0..5), Wrap=True)
mesh_join = MeshJoin(Meshes=flatten([boundary_mesh, mesh_2]))
brep_edges = BrepEdges(Brep=list_item)  # -> Naked, Interior, NonManifold
curve = Curve(brep_edges.Naked)
join_curves = JoinCurves(Curves=curve, Preserve=False)
offset_curve = OffsetCurve(Curve=join_curves, Distance="2", Corners=1)
boundary_surfaces = BoundarySurfaces(Edges=offset_curve)
negative = Negative(Value="1")
offset_surface = OffsetSurface(Surface=boundary_surfaces, Distance=negative, BothSides=0, CreateSolid=True)
panel = Panel("0.50")
mesh_join_2 = MeshJoin(Meshes=flatten([offset_surface, mesh_join]))
series = Series(Start=0, Step="0.5", Count="90")
construct_point = ConstructPoint(XCoordinate=series, YCoordinate=0, ZCoordinate=0)
yz_plane = YZPlane(Origin=Point(0, 0, 0))
shrinkwrap = ShrinkWrap(Geometry=mesh_join_2, EdgeLength=Slider(0.278, range=0.001..1), Offset=0, Smoothing=0, Optimization=10, FillHoles=True)
plane_origin = PlaneOrigin(Base=yz_plane, Origin=construct_point)
mesh_plane = MeshPlane(Mesh=shrinkwrap, Plane=plane_origin)
custom_preview = CustomPreview(Geometry=shrinkwrap, Material=ColourSwatch(SwatchColor=RGB(255, 255, 255)))
boundary_surfaces_2 = BoundarySurfaces(Edges=mesh_plane)
division = Division(A="0.5", B=2)
negative_2 = Negative(Value=division)
colour_swatch = ColourSwatch(SwatchColor=RGB(112, 146, 255))
offset_surface_2 = OffsetSurface(Surface=boundary_surfaces_2, Distance=division, BothSides=negative_2, CreateSolid=True)
create_material = CreateMaterial(
    Diffuse=ColourSwatch(SwatchColor=RGB(255, 112, 112)),
    Specular=colour_swatch,
    Emission=colour_swatch,
    Transparency=0,
    Shine=0)
custom_preview_2 = CustomPreview(Geometry=mesh_plane, Material=ColourSwatch(SwatchColor=RGB(0, 0, 0)))
custom_preview_3 = CustomPreview(Geometry=offset_surface_2, Material=create_material)
