# Grasshopper definition QrCode.gh (Grasshopper 1.0.7)
# plug-ins: Human

toggle = BooleanToggle(False)
python = GhPythonScript(text="qr-art.github.io", display=toggle)  # -> result; inputs display: Boolean
# ---------- python: Python ----------
from ghpythonlib.componentbase import executingcomponent as component
import Grasshopper as gh
import GhPython
import System
import rhinoscriptsyntax as rs
import Rhino as rh
import Rhino.Geometry as rg

import sys

ghcompfolder = gh.Folders.DefaultAssemblyFolder
if ghcompfolder not in sys.path:
    sys.path.append(ghcompfolder)

import qrcode
from qrcode.image.rhino_image import RhinoImage



class MyComponent(component):
    
    def RunScript(self, text, display):

        pt = rh.Display.PointStyle
        self.s = pt.ControlPoint
        self.c = System.Drawing.Color.Black
        self.d = display
        
        img = qrcode.make(text,image_factory=RhinoImage)
        points = img.get_image()
        result = []
        
        if display == False or not display:
            self.p = points
            result = points
        else:
            self.p = None
            for p in points:
                intv = rg.Interval(-0.5,0.5)
                pl = rg.Plane(p,rg.Vector3d(0,0,1))
                rec = rg.Rectangle3d(pl,intv,intv)
                result.append(rec.ToNurbsCurve())
                
        self.r = result
        bb = rs.BoundingBox(result)
        self.bb = rg.BoundingBox(bb)
        return result
# ---------- end python ----------
filter = StreamFilter(Gate=toggle, Stream0=python, Stream1=python)
gate = StreamGate(Stream=filter, Gate=toggle)  # -> Target0, Target1
crv = Curve([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])
srf = Surface(gate.Target0)
area = Area(Geometry=srf)  # -> Area, Centroid
incurves = PointInCurves(Point=area.Centroid, Curves=crv)  # -> Relationship, Index, Point
dispatch = Dispatch(List=srf, DispatchPattern=incurves.Relationship)  # -> ListA, ListB
geo = Geometry(dispatch.ListA)
geo_2 = Geometry(dispatch.ListB)
debrep = DeconstructBrep(Brep=geo_2)  # -> Faces, Edges, Vertices
debrep_2 = DeconstructBrep(Brep=geo)  # -> Faces, Edges, Vertices
join = JoinCurves(Curves=debrep.Edges, Preserve=False)
join_2 = JoinCurves(Curves=debrep_2.Edges, Preserve=False)
crv_2 = Curve(flatten(join))
crv_3 = Curve(flatten(join_2))
runion = RegionUnion(Curves=crv_2)
runion_2 = RegionUnion(Curves=crv_3)
fillet = Fillet(Curve=runion_2, Radius=Slider(1.255, range=0.1..2))
fillet_2 = Fillet(Curve=runion, Radius=Slider(1, range=0.1..1))
boundary = BoundarySurfaces(Edges=fillet_2)
boundary_2 = BoundarySurfaces(Edges=fillet)
merge = Merge(Data1=boundary_2, Data2=boundary)
debrep_3 = DeconstructBrep(Brep=merge)  # -> Faces, Edges, Vertices
panel = Panel("""#124E78
#f2bb05
#d74e09
#6e0e0a""")
panel_2 = Panel("""#124E78
#f2bb05
#6e0e0a""")
crv_4 = Curve(debrep_3.Edges)
python_2 = GhPythonScript(x=panel_2)  # -> out, r, g, b
# ---------- python_2: Python ----------
def hex_to_rgb(hex_string):
    r_hex = hex_string[1:3]
    g_hex = hex_string[3:5]
    b_hex = hex_string[5:7]
    return int(r_hex, 16)/255, int(g_hex, 16)/255, int(b_hex, 16)/255

r,g,b = hex_to_rgb(x)
# ---------- end python_2 ----------
frgb = ColourRGBF(Alpha=1, Red=python_2.r, Green=python_2.g, Blue=python_2.b)
lng = ListLength(List=merge)
previewlw = CustomPreviewLineweights(Geometry=crv_4, Shader=ColourSwatch(SwatchColor=RGB(0, 0, 0)), Absolute=False)
repeat = RepeatData(Data=frgb, Length=lng)
legend = Legend(Colour=frgb, Tags=["One Fish", "Two Fish", "Red Fish", "Blue Fish"], LegendType=1)
number_slider = Slider(2.23, range=0..10)
panel_3 = Panel("""0.5
1.00
1.50""")
repeat_2 = RepeatData(Data=panel_3, Length=lng)
Z = UnitZ(Factor=repeat_2)
extr = Extrude(Base=merge, Direction=Z)
graft = GraftTree(Tree=extr, IncludeEmptyLists=True, IncludeNullItems=True)
graft_2 = GraftTree(Tree=repeat, IncludeEmptyLists=True, IncludeNullItems=True)
mcol = MeshColours(Mesh=graft, Colours=graft_2)
