# Grasshopper definition woman.gh (Grasshopper 1.0.7)
# plug-ins: Weaverbird, Javid, MeshEdit Components

path = FilePath("/Users/mp/Documents/GitHub/qr-art.github.io/pixel-art/assets/woman.jpg")
open = OpenBitmap(File=path)
preview_bitmap = PreviewBitmap(Bitmap=open, LockAspect=False)
python = GhPythonScript(x=open)  # -> out, a, b
# ---------- python: Python ----------
__author__ = "mp"

import rhinoscriptsyntax as rs

a = x.Width
b = x.Height
# ---------- end python ----------
panel = Panel(python.a)
panel_2 = Panel(python.b)
dice_dimension_mm = Panel("10")
target_width_mm = Panel("900")
division = Division(A=panel, B=panel_2)
target_heigth_mm = Panel("1400")
list = ValueList({"width input": 0, "picture ration": 1}, selected="width input")
division_2 = Division(A=target_width_mm, B=division)
filter = StreamFilter(Gate=list, Stream0=target_heigth_mm, Stream1=division_2)
division_3 = Division(A=target_width_mm, B=dice_dimension_mm)
division_4 = Division(A=filter, B=dice_dimension_mm)
range = Range(Domain=filter, Steps=division_4)
range_2 = Range(Domain=target_width_mm, Steps=division_3)
crv = Curve([<curve referenced from the Rhino model> x2])
crv_2 = Curve([<curve referenced from the Rhino model> x3])
crv_3 = Curve([<curve referenced from the Rhino model> x4])
crv_4 = Curve([<curve referenced from the Rhino model> x5])
crv_5 = Curve([<curve referenced from the Rhino model> x6])
crv_6 = Curve([<curve referenced from the Rhino model> x7])
crv_7 = Curve(<curve referenced from the Rhino model>)
lng = ListLength(List=range_2)
lng_2 = ListLength(List=range)
num = Number(expr("x-1", lng))
num_2 = Number(expr("x-1", lng_2))
entwine = Entwine(
    Branch00=crv_7,
    Branch01=crv,
    Branch02=crv_2,
    Branch03=crv_3,
    Branch04=crv_4,
    Branch05=crv_5,
    Branch06=crv_6,
    FlattenInputs=True)
len = Length(Curve=entwine)
sort = SortList(Keys=len, ValuesA=entwine)  # -> Keys, reverse(ValuesA)
range_3 = Range(Domain=Domain(0, 1), Steps=expr("x-1", num_2))
range_4 = Range(Domain=Domain(0, 1), Steps=expr("x-1", num))
rectangle = Rectangle(Plane=PlaneXY(0, 0, 0), XSize=target_width_mm, YSize=filter, Radius=0)  # -> Rectangle, Length
boundary = BoundarySurfaces(Edges=sort.ValuesA)
vec = VectorXYZ(XComponent=graft(range_4), YComponent=range_3, ZComponent=0)  # -> Vector, Length
group = Group(Objects=sort.ValuesA)  # -> simplify(flatten(Group))
image = ImageSampler(
    vec.Vector,
    FilePath="/Users/mp/Documents/GitHub/qr-art.github.io/pixel-art/assets/woman.jpg",
    Filter="Value",
    Interpolate=False,
    Umax=1,
    Umin=0,
    Vmax=1,
    Vmin=0,
    Wrap=1)
srf = Surface(rectangle.Rectangle)
mesh_uv = MeshSurface(Surface=srf, UCount=num, VCount=num_2, Overhang=True, Equalize=False)
tstat = TreeStatistics(Tree=entwine)  # -> Paths, Length, Count
panel_3 = Panel(tstat.Count)
div = DivideDomain(Domain=Domain(0, 1), Count=panel_3)
graph = GraphMapper(
    image,
    x0=0,
    x1=1,
    y0=0,
    y1=1,
    container_name="Bezier",
    cpx=[0, 0.2207544297, 0.5187015533, 1],
    cpy=[0, 0, 0.8753717542, 1])
wbfacepolys = WeaverbirdsFacePolylines(Mesh=mesh_uv)
panel_4 = Panel(num_2)
list_2 = ValueList({"modified": 0, "original": 1}, selected="modified")
partition = PartitionList(List=wbfacepolys, Size=panel_4)
branch = TreeBranch(Tree=simplify(graph), Path="0", MaintainPaths=True)
filter_2 = StreamFilter(Gate=list_2, Stream0=graph, Stream1=image)
fdom = FindDomain(Domains=div, Number=filter_2, Strict=False)  # -> Index, Neighbour
item = ListItem(List=group, Index=fdom.Index, Wrap=True)  # -> simplify(Item)
ungroup = Ungroup(Group=item)  # -> simplify(Objects)
item_2 = ListItem(List=ungroup, Index=0, Wrap=True)
explode = MeshExplode(Mesh=mesh_uv, Interpolate=False)
data = Data(flatten(fdom.Index))
explode_2 = Explode(Curve=partition, Recursive=True)  # -> Segments, Vertices
explode_3 = Explode(Curve=item_2, Recursive=True)  # -> Segments, Vertices
item_3 = ListItem(List=explode_3.Vertices, Index=0, Wrap=True)  # -> Item, Item1, Item2
item_4 = ListItem(List=explode_2.Vertices, Index=0, Wrap=True)  # -> Item, Item1, Item2
cset = CreateSet(List=data)  # -> Set, Map
item_5 = ListItem(List=explode, Index=0, Wrap=True)
panel_5 = Panel(branch)
pl_3pt = Plane3Pt(PointA=item_3.Item, PointB=item_3.Item1, PointC=item_3.Item2)  # -> simplify(Plane)
pl_3pt_2 = Plane3Pt(PointA=item_4.Item, PointB=item_4.Item1, PointC=item_4.Item2)  # -> simplify(Plane)
pshift = ShiftPaths(Data=pl_3pt, Offset=-1)
pshift_2 = ShiftPaths(Data=pl_3pt_2, Offset=-1)
orient = Orient(Geometry=item, Source=pshift, Target=pshift_2)  # -> Geometry, Transform
ungroup_2 = Ungroup(Group=orient.Geometry)
item_6 = ListItem(List=ungroup_2, Index=0, Wrap=True)
explode_4 = Explode(Curve=item_6, Recursive=True)  # -> Segments, Vertices
item_7 = ListItem(List=explode_2.Segments, Index=0, Wrap=True)  # -> simplify(Item)
item_8 = ListItem(List=explode_4.Segments, Index=0, Wrap=True)
len_2 = Length(Curve=item_8)  # -> simplify(Length)
len_3 = Length(Curve=item_7)  # -> simplify(Length)
end = EndPoints(Curve=item_8)  # -> simplify(Start), End
division_5 = Division(A=len_3, B=len_2)
pshift_3 = ShiftPaths(Data=end.Start, Offset=-1)
pshift_4 = ShiftPaths(Data=division_5, Offset=-1)
scale = Scale(Geometry=orient.Geometry, Center=pshift_3, Factor=pshift_4)  # -> Geometry, Transform
ungroup_3 = Ungroup(Group=scale.Geometry)
item_9 = ListItem(List=ungroup_3, Index=0, Wrap=True)
pcen = PolygonCenter(Polyline=item_9)  # -> CenterV, CenterE, CenterA
pshift_5 = ShiftPaths(Data=pcen.CenterV, Offset=-1)
scale_2 = Scale(Geometry=scale.Geometry, Center=pshift_5, Factor="0.99")  # -> Geometry, Transform
ungroup_4 = Ungroup(Group=scale_2.Geometry)
cull_i = CullIndex(List=ungroup_4, Indices="0", Wrap=True)
boundary_2 = BoundarySurfaces(Edges=ungroup_4)
boundary_3 = BoundarySurfaces(Edges=cull_i)
preview = CustomPreview(Geometry=boundary_3, Material=ColourSwatch(SwatchColor=RGB(255, 255, 255)))
preview_2 = CustomPreview(Geometry=boundary_2, Material=ColourSwatch(SwatchColor=RGB(0, 0, 0)))
