# Grasshopper definition woman_2.gh (Grasshopper 1.0.7)
# plug-ins: Weaverbird, Javid, MeshEdit Components, Alpaca4d, Human

path = FilePath("/Users/mp/Documents/GitHub/qr-art.github.io/pixel-art/assets/mercury_2-removebg-preview.png")
open = OpenBitmap(File=path)
bitmap = BitmapFromFile(BitmapPath=path)  # -> Bitmap, Width, Height
preview_bitmap = PreviewBitmap(Bitmap=bitmap.Bitmap, LockAspect=False)
panel = Panel(bitmap.Width)
panel_2 = Panel(bitmap.Height)
dice_dimension_mm = Panel("10")
target_width_mm = Panel("900")
division = Division(A=panel, B=panel_2)
target_heigth_mm = Panel("1400")
list = ValueList({"width input": 0, "picture ration": 1}, selected="picture ration")
division_2 = Division(A=target_width_mm, B=division)
filter = StreamFilter(Gate=list, Stream0=target_heigth_mm, Stream1=division_2)
crv = Curve([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])
crv_2 = Curve([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])
crv_3 = Curve([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])
crv_4 = Curve([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])
crv_5 = Curve([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])
crv_6 = Curve([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])
crv_7 = Curve(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)
division_3 = Division(A=target_width_mm, B=dice_dimension_mm)
division_4 = Division(A=filter, B=dice_dimension_mm)
entwine = Entwine(
    Branch00=crv_7,
    Branch01=crv,
    Branch02=crv_2,
    Branch03=crv_3,
    Branch04=crv_4,
    Branch05=crv_5,
    Branch06=crv_6,
    FlattenInputs=True)
range = Range(Domain=filter, Steps=division_4)
range_2 = Range(Domain=target_width_mm, Steps=division_3)
split = SplitTree(Data=simplify(entwine), Masks=flatten("{!0}"))  # -> Positive, Negative
lng = ListLength(List=range_2)
lng_2 = ListLength(List=range)
list_2 = ValueList({"with black zero dice": 0, "normal dice": 1}, selected="normal dice")
num = Number(expr("x-1", lng))
num_2 = Number(expr("x-1", lng_2))
filter_2 = StreamFilter(Gate=list_2, Stream0=entwine, Stream1=split.Positive)
range_3 = Range(Domain=Domain(0, 1), Steps=expr("x-1", num_2))
len = Length(Curve=filter_2)
range_4 = Range(Domain=Domain(0, 1), Steps=expr("x-1", num))
sort = SortList(Keys=len, ValuesA=filter_2)  # -> Keys, reverse(ValuesA)
vec = VectorXYZ(XComponent=graft(range_4), YComponent=range_3, ZComponent=0)  # -> Vector, Length
samplebmp = SampleBitmap(Bitmap=bitmap.Bitmap, Coordinates=vec.Vector)  # -> Colors, Values
srf = Surface(sort.ValuesA)
cull_i = CullIndex(List=srf, Indices="0", Wrap=True)
boundary = BoundarySurfaces(Edges=srf)
boundary_2 = BoundarySurfaces(Edges=cull_i)
mesh = Mesh(boundary_2)
mesh_2 = Mesh(boundary)
mcol = MeshColours(Mesh=mesh_2, Colours=ColourSwatch(SwatchColor=RGB(0, 0, 0)))
mcol_2 = MeshColours(Mesh=mesh, Colours=ColourSwatch(SwatchColor=RGB(255, 255, 255)))
merge = Merge(Data1=simplify(mcol), Data2=simplify(mcol_2))
geometry = Geometry([<point referenced from the Rhino model> x4])
mjoin = MeshJoin(Meshes=merge)  # -> flatten(Mesh)
list_item = ListItem(List=geometry, Index=0, Wrap=True)  # -> Item, Item1, Item2, Item3
rectangle = Rectangle(Plane=PlaneXY(0, 0, 0), XSize=target_width_mm, YSize=filter, Radius=0)  # -> Rectangle, Length
value_list = ValueList({"0 : rectangle": 0, "1 : 4 points": 1}, selected="0 : rectangle")
tstat = TreeStatistics(Tree=srf)  # -> Paths, Length, Count
graph = GraphMapper(
    samplebmp.Values,
    x0=0,
    x1=1,
    y0=0,
    y1=1,
    container_name="Bezier",
    cpx=[0, 0.7403826714, 0.8260579705, 1],
    cpy=[0, 0.07126891613, 0.5992919803, 1])
list_3 = ValueList({"0 : modified": 0, "1 : original": 1}, selected="0 : modified")
_4point_surface = _4PointSurface(CornerA=list_item.Item, CornerB=list_item.Item1, CornerC=list_item.Item2, CornerD=list_item.Item3)
srf_2 = Surface(rectangle.Rectangle)
panel_3 = Panel(tstat.Count)
div = DivideDomain(Domain=Domain(0, 1), Count=panel_3)
stream_filter = StreamFilter(Gate=value_list, Stream0=srf_2, Stream1=_4point_surface)
filter_3 = StreamFilter(Gate=list_3, Stream0=graph, Stream1=samplebmp.Values)
num_3 = Number(num_2)
fdom = FindDomain(Domains=div, Number=filter_3, Strict=False)  # -> Index, Neighbour
mesh_uv = MeshSurface(Surface=stream_filter, UCount=num, VCount=num_3, Overhang=True, Equalize=False)
group = Group(Objects=srf)  # -> simplify(flatten(Group))
clr = ColorsAlpaca4d(GradientIndex=2)
tstat_2 = TreeStatistics(Tree=srf)  # -> Paths, Length, Count
data = Data(flatten(fdom.Index))
panel_4 = Panel(tstat_2.Count)
int = Integer(data)
explode = MeshExplode(Mesh=mesh_uv, Interpolate=False)
cset = CreateSet(List=int)  # -> Set, Map
panel_5 = Panel(num_3)
range_5 = Range(Domain=Domain(0, 1), Steps=panel_4)
item = ListItem(List=group, Index=fdom.Index, Wrap=True)  # -> simplify(Item)
item_2 = ListItem(List=mjoin, Index=fdom.Index, Wrap=True)
wbfacepolys = WeaverbirdsFacePolylines(Mesh=mesh_uv)
sort_2 = SortList(Keys=cset.Set)  # -> Keys, ValuesA
ungroup = Ungroup(Group=item)  # -> simplify(Objects)
partition = PartitionList(List=wbfacepolys, Size=panel_5)
gradient = Gradient(LowerLimit=0, UpperLimit=1, Parameter=range_5, stops=[0: RGB(255, 254, 254), 1: RGB(0, 0, 0)])
int_2 = Integer(sort_2.Keys)
item_3 = ListItem(List=ungroup, Index=0, Wrap=True)
entwine_2 = Entwine(
    Branch00=ColourSwatch(SwatchColor=RGB(255, 0, 255)),
    Branch01=ColourSwatch(SwatchColor=RGB(0, 255, 254)),
    Branch02=ColourSwatch(SwatchColor=RGB(0, 0, 254)),
    Branch03=ColourSwatch(SwatchColor=RGB(255, 0, 0)),
    Branch04=ColourSwatch(SwatchColor=RGB(255, 254, 0)),
    Branch05=ColourSwatch(SwatchColor=RGB(0, 255, 0)),
    Branch06=ColourSwatch(SwatchColor=RGB(255, 255, 255)),
    FlattenInputs=True)
explode_2 = Explode(Curve=partition, Recursive=True)  # -> Segments, Vertices
mindex = MemberIndex(Set=int, Member=int_2)  # -> Index, Count
explode_3 = Explode(Curve=item_3, Recursive=True)  # -> Segments, Vertices
item_4 = ListItem(List=explode, Index=mindex.Index, Wrap=True)
item_5 = ListItem(List=explode_3.Vertices, Index=0, Wrap=True)  # -> Item, Item1, Item2
item_6 = ListItem(List=explode_2.Vertices, Index=0, Wrap=True)  # -> Item, Item1, Item2
pl_3pt = Plane3Pt(PointA=item_6.Item, PointB=item_6.Item1, PointC=item_6.Item2)  # -> simplify(Plane)
pl_3pt_2 = Plane3Pt(PointA=item_5.Item, PointB=item_5.Item1, PointC=item_5.Item2)  # -> simplify(Plane)
list_4 = ValueList({"gradient": 1, "random": 0, "black-white": 2}, selected="black-white")
graft = GraftTree(Tree=gradient, IncludeEmptyLists=True, IncludeNullItems=True)
pshift = ShiftPaths(Data=pl_3pt_2, Offset=-1)
pshift_2 = ShiftPaths(Data=pl_3pt, Offset=-1)
filter_4 = StreamFilter(Gate=list_4, Stream0=entwine_2, Stream2=graft)
mcol_3 = MeshColours(Mesh=item_4, Colours=filter_4)
mjoin_2 = MeshJoin(Meshes=mcol_3)
mesh_3 = Mesh(mjoin_2)
orient = Orient(Geometry=item_2, Source=pshift, Target=pshift_2)  # -> Geometry, Transform
mjoin_3 = MeshJoin(Meshes=flatten(orient.Geometry))
mjoin_4 = MeshJoin(Meshes=flatten(mcol_3))
weld = WeldMesh(Mesh=mesh_3, Angle=3.141592654)
mesh_4 = Mesh(mjoin_4)
mesh_5 = Mesh(mjoin_3)
wbnaked = WeaverbirdsNakedBoundary(MeshClosedPolylines=weld)
previewlw = CustomPreviewLineweights(Geometry=wbnaked, Shader=ColourSwatch(SwatchColor=RGB(0, 0, 0)), Thickness="4", Absolute=False)
